# Grasshopper definition Brick Wall.ghx (Grasshopper 1.0.7)

panel = Panel("Block Description")
length = Slider(24, range=1..30)
width = Slider(11.5, range=1..15)
height = Slider(5.2, range=0..10)

depth = Slider(112.324, range=0..300)
n_bricks_height = Slider(21.812, range=1..30)
n_bricks_wide = Slider(13.844, range=1..15)
panel_2 = Panel("Wall Paramenters")

h_distance_between_bricks = Slider(17.452, range=12..24)
crv_wall_length = Curve(<curve referenced from the Rhino model>)

width_2 = Slider(11.5, range=1..15)
length_2 = Slider(24, range=1..30)
height_2 = Slider(5.2, range=0..10)

multiplication = Multiplication(A=height, B=n_bricks_height)
multiplication_2 = Multiplication(A=depth, B=length)
reb = RebuildCurve(Curve=crv_wall_length, Count=Slider(50, range=0..100), Tangents=False)
dom = ConstructDomain(DomainStart=0, DomainEnd=depth)
rectangle = Rectangle(Plane=PlaneXY(0, 0, 0), XSize=length, YSize=width, Radius=0)  # -> Rectangle, Length
divdist = DivideDistance(Curve=reb, Distance=h_distance_between_bricks)  # -> Points, Tangents, Parameters
cp = ControlPoints(Curve=reb)  # -> Points, Weights, Knots
series = Series(Start=0, Step=expr("X*1.5", length), Count=n_bricks_wide)
boxrec = BoxRectangle(Rectangle=rectangle.Rectangle, Height=height)
random = Random(Range=dom, Number=n_bricks_wide, Seed=multiplication_2)
random_2 = Random(Range=dom, Number=n_bricks_wide, Seed=2)
v_distance_between_bricks = Slider(5.2, range=0..10)
wall_height = Slider(72, range=0..100)
item = ListItem(List=cp.Points, Index=0, Wrap=True)
debrep = DeconstructBrep(Brep=boxrec)  # -> Faces, Edges, Vertices
culln = CullNth(List=series, CullFrequency=2)
culln_2 = CullNth(List=random_2, CullFrequency=2)
culln_3 = CullNth(List=random, CullFrequency=2)
Y = UnitY(Factor=Slider(7, range=0..10))
item_2 = ListItem(List=debrep.Faces, Index="4", Wrap=True)
pt = ConstructPoint(XCoordinate=culln, YCoordinate=culln_2, ZCoordinate=0)
move = Move(Geometry=item, Motion=Y)  # -> Geometry, Transform
line = LineSDL(Start=divdist.Points, Direction=Vector(0, 0, 1), Length=wall_height)
pt_2 = ConstructPoint(XCoordinate=culln, YCoordinate=culln_3, ZCoordinate=0)
area = Area(Geometry=item_2)  # -> Area, Centroid
divdist_2 = DivideDistance(Curve=line, Distance=v_distance_between_bricks)  # -> Points, Tangents, Parameters
intcrv = Interpolate(Vertices=pt, Degree=3, Periodic=False, KnotStyle=1)  # -> Curve, Length, Domain
intcrv_2 = Interpolate(Vertices=pt_2, Degree=3, Periodic=False, KnotStyle=1)  # -> Curve, Length, Domain
xy = XYPlane(Origin=divdist_2.Points)
Y_2 = UnitY(Factor=1)
Z = UnitZ(Factor=multiplication)
move_2 = Move(Geometry=intcrv_2.Curve, Motion=Z)  # -> Geometry, Transform
align = AlignPlane(Plane=xy, Direction=Y_2)  # -> Plane, Angle
loft = Loft(
    Curves=[intcrv.Curve, move_2.Geometry],
    Options={Adjust=False, Closed=False, LoftEnds=0, LoftSimp=0, LoftType=0, Rebuild=10, Refit=0.01})
contour = Contour(Shape=loft, Point=Point(0, 0, 0), Direction=Vector(0, 0, 1), Distance=height)
dispatch = Dispatch(List=align.Plane, DispatchPattern=[True, False])  # -> ListA, ListB
flip = FlipMatrix(Data=dispatch.ListA)
flip_2 = FlipMatrix(Data=dispatch.ListB)
hframes = HorizontalFrames(Curve=contour, Count=expr("x*2", n_bricks_wide))  # -> Frames, Parameters
orient = Orient(Geometry=boxrec, Source=area.Centroid, Target=hframes.Frames)  # -> flatten(Geometry), Transform
dispatch_2 = Dispatch(List=flip_2, DispatchPattern=[True, False])  # -> ListA, ListB
dispatch_3 = Dispatch(List=flip, DispatchPattern=[True, False])  # -> ListA, ListB
pln = Plane(dispatch_3.ListA)
pln_2 = Plane(dispatch_2.ListB)
culln_4 = CullNth(List=orient.Geometry, CullFrequency=2)
box = DomainBox(Base=[pln, pln_2], X=width_2, Y=length_2, Z=height_2)
