# Grasshopper definition assembly_ex1.ghx (Grasshopper 1.0.7)

update_network_xfunc = PythonScript()  # -> assembly; disabled
# ---------- update_network_xfunc: Python ----------
import os
from climate_active_bricks.assembly import Assembly

#from compas.rpc import Proxy
#n = Proxy('compas.numerical')
#print n

from compas.utilities import XFunc

# make the function available as a wrapped function with the same call signature and return value as the original.
fd_numpy = XFunc('climate_active_bricks.assembly.interfaces_numpy.assembly_interfaces_numpy_fromtojson')

#result = n.assembly_interfaces_numpy(assembly, nmax=100, amin=0.0001)
#print result

# identify the interfaces

filename_from = "stretcher_bond_rhino.json"
filename_to = "stretcher_bond_rhino_interfaces.json"

PATH_FROM = os.path.join(DATA, filename_from)
PATH_TO = os.path.join(DATA, filename_to)


assembly.to_json(PATH_FROM)

#fd_numpy(vertices, edges, fixed, q, loads)
fd_numpy(PATH_FROM, PATH_TO, nmax=100, amin=0.0001)


assembly = Assembly.from_json(PATH_TO)
# ---------- end update_network_xfunc ----------

panel = Panel("Reload libraries")
bang = Button()
unload = PythonScript(bang=bang)
# ---------- unload: Python ----------
from compas_rhino.utilities.misc import get_tolerance
from compas_rhino.utilities.misc import unload_modules

unload_modules("compas")
unload_modules("compas_fab")
unload_modules("ur_online_control")
unload_modules("climate_active_bricks")
unload_modules("assembly_information_model")
# ---------- end unload ----------

# ----
# Ex1
py = PythonScript()  # -> HERE, DATA
# ---------- py: Python ----------
import os

HERE = os.path.dirname(ghdoc.Path)
DATA = os.path.abspath(os.path.join(HERE, "..", "data"))
print(HERE)
print(DATA)
# ---------- end py ----------

# ----
# Element
# Predefine a brick element and its dimensions
# Visualise the defined element
show = BooleanToggle(False)
elem_def = GhPythonScript()  # -> out, elem_full, elem_half
# ---------- elem_def: Python ----------
import os
import sys
import json

from compas.geometry import Frame
from compas.geometry import Vector
from compas.geometry import Box
from compas_fab.robots import Configuration

from assembly_information_model.assembly import Element


# dimensions full brick
width = 0.115
length = 0.240
height = 0.050

elem_full = Element.from_dimensions(length, width, height, "full")
elem_half = Element.from_dimensions(length/2, width, height, "half")
# ---------- end elem_def ----------
draw = PythonScript(elem_full=elem_def.elem_full, elem_half=elem_def.elem_half, show=show)  # -> M, F, S
# ---------- draw: Python ----------
from compas.geometry import Transformation
from compas.geometry import Frame
from compas.datastructures import mesh_transformed
from compas_ghpython.artists import MeshArtist
from compas_ghpython import draw_frame

if show:
    artist = MeshArtist(elem_full.mesh)
    M = [artist.draw_mesh()]
    F = [draw_frame(elem_full.frame)]
    #S = [draw_frame(elem_full._source.frame)]
    
    """
    artist = MeshArtist(elem_half.mesh)
    M += [artist.draw_mesh()]
    F += [draw_frame(elem_half.frame)]
    S += [draw_frame(elem_half._source.frame)]
    """
# ---------- end draw ----------

# ----
# Alternative: from JSON
# load assembly from json file
panel_2 = Panel("brickwall_interfaces_ex1.json")  # disabled
panel_3 = Panel("stretcher_bond_interfaces.json")  # disabled
panel_4 = Panel("brickwall_ex1.json")  # disabled
panel_5 = Panel("stretcher_bond.json")  # disabled
assembly = PythonScript(DATA=py.DATA, filename=panel_2)  # -> assembly; disabled
# ---------- assembly: Python ----------
import os
import sys
sys.path.append(os.path.abspath(os.path.join(DATA, "..")))

from assembly_information_model.assembly import Assembly

filepath = os.path.join(DATA, filename)

assembly = Assembly.from_json(filepath)
#print assembly.element(0).data

#import compas.geometry._primitives

print assembly.element(0).gripping_frame
# ---------- end assembly ----------

pt = Point([<point referenced from the Rhino model> x3])

# ----
# Assembly
y_axis = Curve(<curve referenced from the Rhino model>)
x_axis = Curve(<curve referenced from the Rhino model>)
show_2 = BooleanToggle(False)
plane = PythonScript(plane_axes=[x_axis, y_axis])  # -> plane; inputs plane_axes: list of Curve
# ---------- plane: Python ----------
import Rhino.Geometry as rg

x_axis, y_axis = plane_axes

x_axis = rg.Line(x_axis.PointAtStart, x_axis.PointAtEnd)
y_axis = rg.Line(y_axis.PointAtStart, y_axis.PointAtEnd)

if x_axis.From.DistanceTo(y_axis.From) < 0.01:
    origin = x_axis.From
    xvec = x_axis.Direction
    yvec = y_axis.Direction
elif x_axis.To.DistanceTo(y_axis.To) < 0.01:
    origin = x_axis.To
    xvec = -x_axis.Direction
    yvec = -y_axis.Direction
elif x_axis.From.DistanceTo(y_axis.To) < 0.01:
    origin = x_axis.From
    xvec = x_axis.Direction
    yvec = -y_axis.Direction
elif x_axis.To.DistanceTo(y_axis.From) < 0.01:
    origin = x_axis.To
    xvec = -x_axis.Direction
    yvec = y_axis.Direction

plane = rg.Plane(origin, xvec, yvec)
# ---------- end plane ----------
cp_new = Plane(plane)
generate_assembly = GhPythonScript(elem_full=elem_def.elem_full, elem_half=elem_def.elem_half, transform=Toggle(True), ptransf=cp_new, attr_pts=pt)  # -> assembly; inputs ptransf: Plane, attr_pts: list of Point3d
# ---------- generate_assembly: Python ----------
import Rhino.Geometry as rg
import math
from scriptcontext import sticky as st


from compas.geometry import Frame
from compas.geometry import Transformation
from compas.geometry import Rotation
from compas.geometry import Translation
from compas.geometry import Point

from compas_ghpython.geometry import xtransformed
from compas_ghpython import draw_frame

from assembly_information_model.assembly import Assembly

import Rhino.Geometry as rg



length, width, height = [elem_full._source.xsize, elem_full._source.ysize, elem_full._source.zsize]
#print(width, length, height)

COURSES = 25
BRICKS_PER_COURSE = 10

MORTAR_PERPENDS = 0.025


total_length = BRICKS_PER_COURSE * length + (BRICKS_PER_COURSE - 1) * MORTAR_PERPENDS
gap_even = MORTAR_PERPENDS
gap_uneven = MORTAR_PERPENDS
gap_uneven = (total_length - (BRICKS_PER_COURSE * (length)))/BRICKS_PER_COURSE


assembly = Assembly() # initialize an empty assembly class
planes = [] # just for vizualisation


for row in range(COURSES):
    dy = row * height
    half_brick_ends = row % 2 != 0
    gap = gap_even if row % 2 == 0 else gap_uneven
    dx = 0

    bricks_in_course = BRICKS_PER_COURSE + (1 if half_brick_ends else 0)
    for j in range(bricks_in_course):

        first = j == 0
        last = j == bricks_in_course - 1

        is_half_brick = (first or last) and half_brick_ends

        if is_half_brick:
            if last:
                T = Translation([dx - width/2, 0, dy])
            else:
                T = Translation([dx - width/2-gap/2, 0, dy])
            e = elem_half.transformed(T)
            dx += width+gap/2
        else:
            T = Translation([dx, 0, dy])
            e = elem_full.transformed(T)
            dx += length
        
        cpt = e.gripping_frame.point
        
        #apply rotation to the bricks according to the distance of the attractor points
        min_dist = 10
        for attr_pt in attr_pts:
            dist =  attr_pt.DistanceTo(rg.Point3d(cpt.x, cpt.y, cpt.z))
            if dist<min_dist:
                min_dist = dist
            #print dist
        dist = min_dist
        R = Rotation.from_axis_and_angle([0,0,1], math.radians(1/(0.3*dist*dist)), point=e.gripping_frame.point) 
        e.transform(R)
        planes.append(draw_frame(e.gripping_frame))
        assembly.add_element(e)
        dx += gap

if transform:
    T = Transformation.from_frame_to_frame(Frame.worldXY(), Frame(ptransf.Origin, ptransf.XAxis, ptransf.YAxis))
    assembly.transform(T)
# ---------- end generate_assembly ----------
update_network = PythonScript(DATA=py.DATA, compute_interfaces_numpy=show_2, assembly=generate_assembly)  # -> assembly
# ---------- update_network: Python ----------
from assembly_information_model.assembly.courses import assembly_courses, assembly_with_interfaces_courses


if compute_interfaces_numpy:
    import os
    from compas.rpc import Proxy
    from assembly_information_model.assembly import Assembly
    p = Proxy('assembly_information_model.assembly.interfaces_numpy')
    p.stop_server()
    p.start_server()

    filename_before = "brickwall_ex1.json"
    filename_after = "brickwall_interfaces_ex1.json"

    PATH_BEFORE = os.path.join(DATA, filename_before)
    PATH_AFTER = os.path.join(DATA, filename_after)
    
    # the assembly has to be serialized such that it can be called from CPython
    assembly.to_json(PATH_BEFORE)
    
    # call the CPython Function using COMPAS RPC
    p.assembly_interfaces_numpy_fromtojson(PATH_BEFORE, PATH_AFTER, nmax=10, amin = 0.0001)

    assembly = Assembly.from_json(PATH_AFTER)


# now compute the courses
assembly_courses(assembly)

# example test: get the bottom keys
c_min = min(assembly.network.nodes_attribute(name='course'))
#print(c_min)
#keys_on_bottom = list(assembly.network.vertices_where({'course': c_min}))
#print(keys_on_bottom)

# example test: get the top keys
c_max = max(assembly.network.nodes_attribute(name='course'))
#print(c_max)
#keys_on_top = list(assembly.network.vertices_where({'course': c_max}))
#print(keys_on_top)
# ---------- end update_network ----------

# ----
# to JSON
export = Button()
export_2 = PythonScript(DATA=py.DATA, export_to_json=export, assembly=generate_assembly)
# ---------- export_2: Python ----------
import os

if export_to_json:
    
    filename = "brickwall_ex1.json"
    PATH = os.path.join(DATA, filename)
    
    # the assembly has to be serialized such that it can be called from CPython
    assembly.to_json(PATH)
# ---------- end export_2 ----------

list = ValueList({"20", "50", "100", "500", "1000", "5000"}, selected="50")
back = Button()
reset = Button()
start = Button()
stop = Button()
step = Button()
full = Button()

# ----
# Draw
# Visualise the entire assembly and its underlying network topology.
counter = CountThroughList(assembly=update_network, start=start, stop=stop, step=step, step_back=back, reset=reset, full=full, interval=list)  # -> item, counter; inputs start: Boolean, stop: Boolean, step_back: Boolean
# ---------- counter: Python ----------
from scriptcontext import sticky as st
from compas_ghpython import update_component


L = list(assembly.elements())
# store data in component
guid = str(ghenv.Component.InstanceGuid)
counter_key = "counter_" + guid
running_key = "running_" + guid

if counter_key not in st:
    st[counter_key] = 0

if running_key not in st:
    st[running_key] = False
    

if st[running_key]:
    if st[counter_key] < len(L) - 1:
        st[counter_key] += 1
        update_component(ghenv, interval)
    else:
        st[counter_key] = 0
        st[running_key] = False
    
    
if start:
    st[running_key] = True

if stop:
    st[running_key] = False

if step:
    if st[counter_key] < len(L) - 1:
        st[counter_key] += 1

if step_back:
    if st[counter_key] < len(L) - 1:
        st[counter_key] -= 1

if reset:
    st[counter_key] = 0

if full:
    st[counter_key] = len(L)-1

if len(L):
    item = L[st[counter_key]]



#st["visualisation_counter"] = st[counter_key]
#st[counter_key]= 50
counter = st[counter_key]
# ---------- end counter ----------
idx = Panel(counter.counter)

# ---- group: Network Connectivity Preview
show_3 = BooleanToggle(True)
show_4 = BooleanToggle(True)
show_5 = BooleanToggle(True)
show_6 = BooleanToggle(True)
show_7 = BooleanToggle(True)
draw_2 = PythonScript(
    assembly=update_network,
    show_element=show_3,
    show_neighbors=show_4,
    show_course=show_5,
    show_connections=show_6,
    show_sequencing=show_7,
    counter=idx)  # -> G_element, G_neighbors, G_course, G_connections, G_sequence, counter; inputs counter: Int32
# ---------- draw_2: Python ----------
import os
import sys

import math

import Rhino.Geometry as rg

from compas_ghpython.artists import MeshArtist
from compas_ghpython import draw_frame


G_element = []
G_neighbors = []
G_course = []

key_index = assembly.network.key_index()
keys = [key_index[key] for key in assembly.network.nodes()]


if show_element:
    element = assembly.element(counter)
    artist = MeshArtist(element.mesh)
    mesh = artist.draw_mesh()
    G_element.append(mesh)

if show_neighbors:
    nbrs = [key_index[key] for key in assembly.network.neighbors(key=counter)]
    elements = [assembly.element(key) for key in nbrs]
    for element in elements:
        artist = MeshArtist(element.mesh)
        mesh = artist.draw_mesh()
        G_neighbors.append(mesh)

if show_course:
    course = assembly.network.node_attribute(key=counter, name='course')
    keys_in_course = list(assembly.network.nodes_where({'course': course}))
    elements = [assembly.element(key) for key in keys_in_course]
    for element in elements:
        artist = MeshArtist(element.mesh)
        mesh = artist.draw_mesh()
        G_course.append(mesh)

if show_connections:
    #elements = [assembly.element(key) for key in keys]
    #lines = assembly.network.to_lines() #does not work because edges are not transformed!
    G_connections = []
    edges = list(assembly.connections())
    for e in edges:
        p1 = assembly.element(e[0]).frame.point
        p2 = assembly.element(e[1]).frame.point
        G_connections += [rg.Line(p1[0],p1[1],p1[2],p2[0],p2[1],p2[2])]

if show_sequencing:
    from assembly_information_model.assembly.sequencing import assembly_building_sequence
    sequ = assembly_building_sequence(assembly, counter)
    print sequ 
    G_sequence = []
    elements = [assembly.element(key) for key in sequ]
    for element in elements:
        artist = MeshArtist(element.mesh)
        mesh = artist.draw_mesh()
        G_sequence.append(mesh)
# ---------- end draw_2 ----------
geo = Geometry(draw_2.G_element)
geo_2 = Geometry(draw_2.G_neighbors)
geo_3 = Geometry(draw_2.G_course)
geo_4 = Geometry(draw_2.G_connections)
geo_5 = Geometry(draw_2.G_sequence)
preview = CustomPreview(Geometry=geo_2, Shader=ColourSwatch(SwatchColor=RGB(255, 212, 212)))
preview_2 = CustomPreview(Geometry=geo_3, Shader=ColourSwatch(SwatchColor=RGB(255, 204, 0)))
preview_3 = CustomPreview(Geometry=geo_4, Shader=ColourSwatch(SwatchColor=RGB(0, 0, 0)))
preview_4 = CustomPreview(Geometry=geo, Shader=ColourSwatch(SwatchColor=RGB(255, 143, 143)))
preview_5 = CustomPreview(Geometry=geo_5, Shader=ColourSwatch(SwatchColor=RGBA(255, 221, 135, 22)))

# ---- group: Assembly Artist
show_8 = BooleanToggle(True)
show_9 = BooleanToggle(False)
draw_3 = PythonScript(assembly=update_network, show_all=show_8, show_counter=show_9, counter=draw_2.counter)  # -> G, gripping_planes_WCS, current_gripping_plane; inputs counter: Int32
# ---------- draw_3: Python ----------
import os
import sys

import math

from compas_ghpython.artists import MeshArtist
from compas_ghpython import draw_frame


G = []

key_index = assembly.network.key_index()
keys = [key_index[key] for key in assembly.network.nodes()]
elements = [assembly.element(key) for key in keys]
#print elements
#print([(e.gripping_frame) for e in elements])

gripping_planes_WCS = [draw_frame(e.gripping_frame) for e in elements]

current_gripping_plane = gripping_planes_WCS[counter]

if show_all and not show_counter:
    for element in elements:
        artist = MeshArtist(element.mesh)
        mesh = artist.draw_mesh()
        G.append(mesh)

if show_counter:
    for element in elements[0:counter+1]:
        artist = MeshArtist(element.mesh)
        mesh = artist.draw_mesh()
        G.append(mesh)
# ---------- end draw_3 ----------
geo_6 = Geometry(draw_3.G)
pln = Plane(draw_3.gripping_planes_WCS)
pln_2 = Plane(draw_3.current_gripping_plane)
preview_6 = CustomPreview(Geometry=pln, Shader=ColourSwatch(SwatchColor=RGB(178, 178, 178)))
preview_7 = CustomPreview(Geometry=geo_6, Shader=ColourSwatch(SwatchColor=RGB(255, 255, 255)))
