# Grasshopper definition assembly_ex3.ghx (Grasshopper 1.0.7)

update_network_xfunc = PythonScript()  # -> assembly; disabled
# ---------- update_network_xfunc: Python ----------
import os
from climate_active_bricks.assembly import Assembly

#from compas.rpc import Proxy
#n = Proxy('compas.numerical')
#print n

from compas.utilities import XFunc

# make the function available as a wrapped function with the same call signature and return value as the original.
fd_numpy = XFunc('climate_active_bricks.assembly.interfaces_numpy.assembly_interfaces_numpy_fromtojson')

#result = n.assembly_interfaces_numpy(assembly, nmax=100, amin=0.0001)
#print result

# identify the interfaces

filename_from = "stretcher_bond_rhino.json"
filename_to = "stretcher_bond_rhino_interfaces.json"

PATH_FROM = os.path.join(DATA, filename_from)
PATH_TO = os.path.join(DATA, filename_to)


assembly.to_json(PATH_FROM)

#fd_numpy(vertices, edges, fixed, q, loads)
fd_numpy(PATH_FROM, PATH_TO, nmax=100, amin=0.0001)


assembly = Assembly.from_json(PATH_TO)
# ---------- end update_network_xfunc ----------

panel = Panel("Reload libraries")
bang = Button()
unload = PythonScript(bang=bang)
# ---------- unload: Python ----------
from compas_rhino.utilities.misc import get_tolerance
from compas_rhino.utilities.misc import unload_modules

unload_modules("compas")
unload_modules("compas_fab")
unload_modules("ur_online_control")
unload_modules("climate_active_bricks")
# ---------- end unload ----------

# ----
# Ex3
py = PythonScript()  # -> HERE, DATA
# ---------- py: Python ----------
import os

HERE = os.path.dirname(ghdoc.Path)
DATA = os.path.abspath(os.path.join(HERE, "..", "data"))
print(HERE)
print(DATA)
# ---------- end py ----------

# ----
# Element
# Predefine a brick element and its dimensions
# Visualise the defined element
show = BooleanToggle(False)
elem_def = GhPythonScript()  # -> out, elem_full, elem_half
# ---------- elem_def: Python ----------
import os
import sys
import json

from compas.geometry import Frame
from compas.geometry import Vector
from compas.geometry import Box
from compas_fab.robots import Configuration

from climate_active_bricks.assembly import Element


# dimensions full brick
width = 0.115 #* 1000
length = 0.240 #* 1000
height = 0.050 #* 1000

elem_full = Element.from_dimensions(length, width, height, "full")
elem_half = Element.from_dimensions(length/2, width, height, "half")
# ---------- end elem_def ----------
draw = PythonScript(elem_full=elem_def.elem_full, elem_half=elem_def.elem_half, show=show)  # -> M, F, S
# ---------- draw: Python ----------
from compas.geometry import Transformation
from compas.geometry import Frame
from compas.datastructures import mesh_transformed
from compas_ghpython.artists import MeshArtist
from compas_ghpython import draw_frame

if show:
    artist = MeshArtist(elem_full.mesh)
    M = [artist.draw_mesh()]
    F = [draw_frame(elem_full.frame)]
    S = [draw_frame(elem_full._source.frame)]
    
    artist = MeshArtist(elem_half.mesh)
    M += [artist.draw_mesh()]
    F += [draw_frame(elem_half.frame)]
    S += [draw_frame(elem_half.frame)]
# ---------- end draw ----------

panel_2 = Panel("brickwall_interfaces_ex3.json")  # disabled

# ----
# Alternative: from JSON
# load assembly from json file
panel_3 = Panel("stretcher_bond_interfaces.json")  # disabled
panel_4 = Panel("stretcher_bond.json")  # disabled
assembly = PythonScript(DATA=py.DATA, filename=panel_2)  # -> assembly; disabled
# ---------- assembly: Python ----------
import os
import sys
sys.path.append(os.path.abspath(os.path.join(DATA, "..")))

from climate_active_bricks.assembly import Assembly

filepath = os.path.join(DATA, filename)

assembly = Assembly.from_json(filepath)
# ---------- end assembly ----------

n_bricks_wide = Slider(13.622, range=1..50)
depth = Slider(300, range=0..300)
n_bricks_height = Slider(30, range=1..30)

length = Slider(240, range=1..240)
width = Slider(115, range=1..115)
height = Slider(50, range=0..50)

rectangle = Rectangle(Plane=PlaneXY(0, 0, 0), XSize=length, YSize=width, Radius=0)  # -> Rectangle, Length
multiplication = Multiplication(A=depth, B=length)
multiplication_2 = Multiplication(A=height, B=n_bricks_height)
dom = ConstructDomain(DomainStart=0, DomainEnd=depth)
boxrec = BoxRectangle(Rectangle=rectangle.Rectangle, Height=height)
series = Series(Start=0, Step=expr("X*1.5", length), Count=n_bricks_wide)
debrep = DeconstructBrep(Brep=boxrec)  # -> Faces, Edges, Vertices
random = Random(Range=dom, Number=n_bricks_wide, Seed=2)
random_2 = Random(Range=dom, Number=n_bricks_wide, Seed=multiplication)
culln = CullNth(List=series, CullFrequency=2)
culln_2 = CullNth(List=random, CullFrequency=2)
culln_3 = CullNth(List=random_2, CullFrequency=2)
item = ListItem(List=debrep.Faces, Index="4", Wrap=True)
pt = ConstructPoint(XCoordinate=culln, YCoordinate=culln_2, ZCoordinate=0)
pt_2 = ConstructPoint(XCoordinate=culln, YCoordinate=culln_3, ZCoordinate=0)
area = Area(Geometry=item)  # -> Area, Centroid
intcrv = Interpolate(Vertices=pt, Degree=3, Periodic=False, KnotStyle=1)  # -> Curve, Length, Domain
intcrv_2 = Interpolate(Vertices=pt_2, Degree=3, Periodic=False, KnotStyle=1)  # -> Curve, Length, Domain
Z = UnitZ(Factor=multiplication_2)
move = Move(Geometry=intcrv_2.Curve, Motion=Z)  # -> Geometry, Transform
loft = Loft(
    Curves=[intcrv.Curve, move.Geometry],
    Options={Adjust=False, Closed=False, LoftEnds=0, LoftSimp=0, LoftType=0, Rebuild=10, Refit=0.01})
contour = Contour(Shape=loft, Point=Point(0, 0, 0), Direction=Vector(0, 0, 1), Distance=height)
hframes = HorizontalFrames(Curve=contour, Count=expr("x*2", n_bricks_wide))  # -> Frames, Parameters
orient = Orient(Geometry=boxrec, Source=area.Centroid, Target=hframes.Frames)  # -> flatten(Geometry), Transform
culln_4 = CullNth(List=orient.Geometry, CullFrequency=2)
box = EvaluateBox(Box=culln_4, UParameter=0.5, VParameter=0.5, WParameter=0.5)  # -> Plane, Point, Include
scale = Scale(Geometry=box.Plane, Center=Point(0, 0, 0), Factor=0.001)  # -> Geometry, Transform

# ----
# Assembly
x_axis = Curve(<curve referenced from the Rhino model>)
y_axis = Curve(<curve referenced from the Rhino model>)
show_2 = BooleanToggle(False)
plane = PythonScript(plane_axes=[x_axis, y_axis])  # -> plane; inputs plane_axes: list of Curve
# ---------- plane: Python ----------
import Rhino.Geometry as rg

x_axis, y_axis = plane_axes

x_axis = rg.Line(x_axis.PointAtStart, x_axis.PointAtEnd)
y_axis = rg.Line(y_axis.PointAtStart, y_axis.PointAtEnd)

if x_axis.From.DistanceTo(y_axis.From) < 0.01:
    origin = x_axis.From
    xvec = x_axis.Direction
    yvec = y_axis.Direction
elif x_axis.To.DistanceTo(y_axis.To) < 0.01:
    origin = x_axis.To
    xvec = -x_axis.Direction
    yvec = -y_axis.Direction
elif x_axis.From.DistanceTo(y_axis.To) < 0.01:
    origin = x_axis.From
    xvec = x_axis.Direction
    yvec = -y_axis.Direction
elif x_axis.To.DistanceTo(y_axis.From) < 0.01:
    origin = x_axis.To
    xvec = -x_axis.Direction
    yvec = y_axis.Direction

plane = rg.Plane(origin, xvec, yvec)
# ---------- end plane ----------
cp_new = Plane(plane)
generate_assembly = GhPythonScript(
    planes=scale.Geometry,
    elem_full=elem_def.elem_full,
    elem_half=elem_def.elem_half,
    transform=Toggle(True),
    ptransf=cp_new)  # -> assembly; inputs planes: list of Plane, ptransf: Plane
# ---------- generate_assembly: Python ----------
import Rhino.Geometry as rg
import math
from scriptcontext import sticky as st


from compas.geometry import Frame
from compas.geometry import Transformation
from compas.geometry import Rotation
from compas.geometry import Translation
from compas.geometry import Point

from compas_ghpython.geometry import xtransformed
from compas_ghpython import draw_frame

from climate_active_bricks.assembly import Assembly

import Rhino.Geometry as rg



assembly = Assembly() # initialize an empty assembly class



for i, plane in enumerate(planes):

    plane = rg.Plane(plane)
    T = Transformation.from_frame_to_frame(Frame.worldXY(), Frame(plane.Origin, plane.XAxis, plane.YAxis))
    e = elem_full.transformed(T)
    assembly.add_element(e)

if transform:
    T = Transformation.from_frame_to_frame(Frame.worldXY(), Frame(ptransf.Origin, ptransf.XAxis, ptransf.YAxis))
    assembly.transform(T)
# ---------- end generate_assembly ----------
update_network = PythonScript(DATA=py.DATA, compute_interfaces_numpy=show_2, assembly=generate_assembly)  # -> assembly
# ---------- update_network: Python ----------
from climate_active_bricks.assembly.courses import assembly_courses, assembly_with_interfaces_courses


if compute_interfaces_numpy:
    import os
    from compas.rpc import Proxy
    from climate_active_bricks.assembly import Assembly
    p = Proxy('climate_active_bricks.assembly.interfaces_numpy')
    #p.stop_server()
    #p.start_server()

    filename_before = "brickwall_ex3.json"
    filename_after = "brickwall_interfaces_ex3.json"

    PATH_BEFORE = os.path.join(DATA, filename_before)
    PATH_AFTER = os.path.join(DATA, filename_after)
    
    # the assembly has to be serialized such that it can be called from CPython
    assembly.to_json(PATH_BEFORE)
    
    # call the CPython Function using COMPAS RPC
    p.assembly_interfaces_numpy_fromtojson(PATH_BEFORE, PATH_AFTER, nmax=10, amin=0.0001)

    assembly = Assembly.from_json(PATH_AFTER)


# now compute the courses
assembly_courses(assembly)

# example test: get the bottom keys
c_min = min(assembly.network.get_vertices_attribute('course'))
#print(c_min)
#keys_on_bottom = list(assembly.network.vertices_where({'course': c_min}))
#print(keys_on_bottom)

# example test: get the top keys
c_max = max(assembly.network.get_vertices_attribute('course'))
#print(c_max)
#keys_on_top = list(assembly.network.vertices_where({'course': c_max}))
#print(keys_on_top)
# ---------- end update_network ----------

list = ValueList({"20", "50", "100", "500", "1000", "5000"}, selected="50")
back = Button()
reset = Button()
start = Button()
stop = Button()
step = Button()
full = Button()

# ----
# Draw
# Visualise the entire assembly and its underlying network topology.
counter = CountThroughList(assembly=update_network, start=start, stop=stop, step=step, step_back=back, reset=reset, full=full, interval=list)  # -> item, counter; inputs start: Boolean, stop: Boolean, step_back: Boolean
# ---------- counter: Python ----------
from scriptcontext import sticky as st
from compas_ghpython import update_component


L = list(assembly.elements())
# store data in component
guid = str(ghenv.Component.InstanceGuid)
counter_key = "counter_" + guid
running_key = "running_" + guid

if counter_key not in st:
    st[counter_key] = 0

if running_key not in st:
    st[running_key] = False
    

if st[running_key]:
    if st[counter_key] < len(L) - 1:
        st[counter_key] += 1
        update_component(ghenv, interval)
    else:
        st[counter_key] = 0
        st[running_key] = False
    
    
if start:
    st[running_key] = True

if stop:
    st[running_key] = False

if step:
    if st[counter_key] < len(L) - 1:
        st[counter_key] += 1

if step_back:
    if st[counter_key] < len(L) - 1:
        st[counter_key] -= 1

if reset:
    st[counter_key] = 0

if full:
    st[counter_key] = len(L)-1

if len(L):
    item = L[st[counter_key]]



#st["visualisation_counter"] = st[counter_key]
counter = st[counter_key]
# ---------- end counter ----------
idx = Panel(counter.counter)

# ---- group: Network Connectivity Preview
show_3 = BooleanToggle(True)
show_4 = BooleanToggle(True)
show_5 = BooleanToggle(False)
show_6 = BooleanToggle(False)
show_7 = BooleanToggle(True)
draw_2 = PythonScript(
    assembly=update_network,
    show_element=show_3,
    show_neighbors=show_4,
    show_course=show_5,
    show_connections=show_6,
    show_sequencing=show_7,
    counter=idx)  # -> G_element, G_neighbors, G_course, G_connections, G_sequence, counter; inputs counter: Int32
# ---------- draw_2: Python ----------
import os
import sys

import math

import Rhino.Geometry as rg

from compas_ghpython.artists import MeshArtist
from compas_ghpython import draw_frame


G_element = []
G_neighbors = []
G_course = []

key_index = assembly.network.key_index()
keys = [key_index[key] for key in assembly.network.vertices()]


if show_element:
    element = assembly.element(counter)
    artist = MeshArtist(element.mesh)
    mesh = artist.draw_mesh()
    G_element.append(mesh)

if show_neighbors:
    nbrs = [key_index[key] for key in assembly.network.vertex_neighbors(counter)]
    elements = [assembly.element(key) for key in nbrs]
    for element in elements:
        artist = MeshArtist(element.mesh)
        mesh = artist.draw_mesh()
        G_neighbors.append(mesh)

if show_course:
    course = assembly.network.get_vertex_attribute(counter, 'course')
    keys_in_course = list(assembly.network.vertices_where({'course': course}))
    elements = [assembly.element(key) for key in keys_in_course]
    for element in elements:
        artist = MeshArtist(element.mesh)
        mesh = artist.draw_mesh()
        G_course.append(mesh)

if show_connections:
    #elements = [assembly.element(key) for key in keys]
    #lines = assembly.network.to_lines() #does not work because edges are not transformed!
    G_connections = []
    edges = list(assembly.connections())
    for e in edges:
        p1 = assembly.element(e[0]).frame.point
        p2 = assembly.element(e[1]).frame.point
        G_connections += [rg.Line(p1[0],p1[1],p1[2],p2[0],p2[1],p2[2])]

if show_sequencing:
    from climate_active_bricks.assembly.sequencing import assembly_building_sequence
    sequ = assembly_building_sequence(assembly, counter)
    print sequ 
    G_sequence = []
    elements = [assembly.element(key) for key in sequ]
    for element in elements:
        artist = MeshArtist(element.mesh)
        mesh = artist.draw_mesh()
        G_sequence.append(mesh)
# ---------- end draw_2 ----------
geo = Geometry(draw_2.G_element)
geo_2 = Geometry(draw_2.G_neighbors)
geo_3 = Geometry(draw_2.G_course)
geo_4 = Geometry(draw_2.G_connections)
geo_5 = Geometry(draw_2.G_sequence)
preview = CustomPreview(Geometry=geo_2, Shader=ColourSwatch(SwatchColor=RGB(255, 212, 212)))
preview_2 = CustomPreview(Geometry=geo_4, Shader=ColourSwatch(SwatchColor=RGB(0, 0, 0)))
preview_3 = CustomPreview(Geometry=geo, Shader=ColourSwatch(SwatchColor=RGB(255, 143, 143)))
preview_4 = CustomPreview(Geometry=geo_3, Shader=ColourSwatch(SwatchColor=RGB(255, 204, 0)))
preview_5 = CustomPreview(Geometry=geo_5, Shader=ColourSwatch(SwatchColor=RGBA(255, 221, 135, 22)))

# ---- group: Assembly Artist
show_8 = BooleanToggle(True)
show_9 = BooleanToggle(False)
draw_3 = PythonScript(assembly=update_network, show_all=show_8, show_counter=show_9, counter=draw_2.counter)  # -> G, gripping_planes_WCS, current_gripping_plane; inputs counter: Int32
# ---------- draw_3: Python ----------
import os
import sys

import math

from compas_ghpython.artists import MeshArtist
from compas_ghpython import draw_frame


G = []

key_index = assembly.network.key_index()
keys = [key_index[key] for key in assembly.network.vertices()]
elements = [assembly.element(key) for key in keys]
#print elements
#print([(e.gripping_frame) for e in elements])

gripping_planes_WCS = [draw_frame(e.gripping_frame) for e in elements]

current_gripping_plane = gripping_planes_WCS[counter]

if show_all and not show_counter:
    for element in elements:
        artist = MeshArtist(element.mesh)
        mesh = artist.draw_mesh()
        G.append(mesh)

if show_counter:
    for element in elements[0:counter+1]:
        artist = MeshArtist(element.mesh)
        mesh = artist.draw_mesh()
        G.append(mesh)
# ---------- end draw_3 ----------
geo_6 = Geometry(draw_3.G)
pln = Plane(draw_3.gripping_planes_WCS)
pln_2 = Plane(draw_3.current_gripping_plane)
preview_6 = CustomPreview(Geometry=pln, Shader=ColourSwatch(SwatchColor=RGB(178, 178, 178)))
preview_7 = CustomPreview(Geometry=geo_6, Shader=ColourSwatch(SwatchColor=RGB(255, 255, 255)))
