# Grasshopper definition assembly_ex4_solar.ghx (Grasshopper 1.0.7)

panel = Panel("Reload libraries")
bang = Button()
unload = PythonScript(bang=bang)
# ---------- unload: Python ----------
from compas_rhino.utilities.misc import get_tolerance
from compas_rhino.utilities.misc import unload_modules

unload_modules("compas")
unload_modules("compas_fab")
unload_modules("ur_online_control")
unload_modules("climate_active_bricks")
# ---------- end unload ----------

# ----
# Ex4
py = PythonScript()  # -> HERE, DATA
# ---------- py: Python ----------
import os

HERE = os.path.dirname(ghdoc.Path)
DATA = os.path.abspath(os.path.join(HERE, "..", "data"))
print(HERE)
print(DATA)
# ---------- end py ----------

# ----
# Alternative: from JSON
# load assembly from json file
panel_2 = Panel("brickwall_interfaces_ex2.json")
assembly = PythonScript(DATA=py.DATA, filename=panel_2)  # -> assembly
# ---------- assembly: Python ----------
import os
import sys
sys.path.append(os.path.abspath(os.path.join(DATA, "..")))

from climate_active_bricks.assembly import Assembly

filepath = os.path.join(DATA, filename)

assembly = Assembly.from_json(filepath)
# ---------- end assembly ----------

list = ValueList({"20", "50", "100", "500", "1000", "5000"}, selected="50")
back = Button()
reset = Button()
start = Button()
stop = Button()
step = Button()
full = Button()

# ----
# Draw
# Visualise the entire assembly and its underlying network topology.
counter = CountThroughList(assembly=assembly, start=start, stop=stop, step=step, step_back=back, reset=reset, full=full, interval=list)  # -> item, counter; inputs start: Boolean, stop: Boolean, step_back: Boolean
# ---------- counter: Python ----------
from scriptcontext import sticky as st
from compas_ghpython import update_component


L = list(assembly.elements())
# store data in component
guid = str(ghenv.Component.InstanceGuid)
counter_key = "counter_" + guid
running_key = "running_" + guid

if counter_key not in st:
    st[counter_key] = 0

if running_key not in st:
    st[running_key] = False
    

if st[running_key]:
    if st[counter_key] < len(L) - 1:
        st[counter_key] += 1
        update_component(ghenv, interval)
    else:
        st[counter_key] = 0
        st[running_key] = False
    
    
if start:
    st[running_key] = True

if stop:
    st[running_key] = False

if step:
    if st[counter_key] < len(L) - 1:
        st[counter_key] += 1

if step_back:
    if st[counter_key] < len(L) - 1:
        st[counter_key] -= 1

if reset:
    st[counter_key] = 0

if full:
    st[counter_key] = len(L)-1

if len(L):
    item = L[st[counter_key]]



#st["visualisation_counter"] = st[counter_key]
counter = st[counter_key]
# ---------- end counter ----------
idx = Panel(counter.counter)

# ---- group: Assembly Artist
show = BooleanToggle(True)
show_2 = BooleanToggle(False)
draw = PythonScript(assembly=assembly, show_all=show, show_counter=show_2, counter=counter.counter)  # -> G, gripping_planes_WCS, current_gripping_plane; inputs counter: Int32
# ---------- draw: Python ----------
import os
import sys

import math

from compas_ghpython.artists import MeshArtist
from compas_ghpython import draw_frame


G = []

key_index = assembly.network.key_index()
keys = [key_index[key] for key in assembly.network.vertices()]
elements = [assembly.element(key) for key in keys]
#print elements
#print([(e.gripping_frame) for e in elements])

gripping_planes_WCS = [draw_frame(e.gripping_frame) for e in elements]

current_gripping_plane = gripping_planes_WCS[counter]

if show_all and not show_counter:
    for element in elements:
        artist = MeshArtist(element.mesh)
        mesh = artist.draw_mesh()
        G.append(mesh)

if show_counter:
    for element in elements[0:counter+1]:
        artist = MeshArtist(element.mesh)
        mesh = artist.draw_mesh()
        G.append(mesh)
# ---------- end draw ----------
geo = Geometry(draw.G)
pln = Plane(draw.gripping_planes_WCS)
pln_2 = Plane(draw.current_gripping_plane)
preview = CustomPreview(Geometry=pln, Shader=ColourSwatch(SwatchColor=RGB(178, 178, 178)))
preview_2 = CustomPreview(Geometry=geo, Shader=ColourSwatch(SwatchColor=RGB(255, 255, 255)))

# ---- group: Network Connectivity Preview
show_3 = BooleanToggle(True)
show_4 = BooleanToggle(False)
show_5 = BooleanToggle(False)
show_6 = BooleanToggle(False)
show_7 = BooleanToggle(False)
draw_2 = PythonScript(
    assembly=assembly,
    show_element=show_3,
    show_neighbors=show_4,
    show_course=show_5,
    show_connections=show_6,
    show_sequencing=show_7,
    counter=idx,
    course=Slider(10, range=0..40))  # -> G_element, G_neighbors, G_course, G_connections, G_sequence, counter; inputs counter: Int32, course: Int32
# ---------- draw_2: Python ----------
import os
import sys

import math

import Rhino.Geometry as rg

from compas_ghpython.artists import MeshArtist
from compas_ghpython import draw_frame


G_element = []
G_neighbors = []
G_course = []

key_index = assembly.network.key_index()
keys = [key_index[key] for key in assembly.network.vertices()]


if show_element:
    element = assembly.element(counter)
    artist = MeshArtist(element.mesh)
    mesh = artist.draw_mesh()
    G_element.append(mesh)

if show_neighbors:
    nbrs = [key_index[key] for key in assembly.network.vertex_neighbors(counter)]
    elements = [assembly.element(key) for key in nbrs]
    for element in elements:
        artist = MeshArtist(element.mesh)
        mesh = artist.draw_mesh()
        G_neighbors.append(mesh)

if show_course:
    #course = assembly.network.get_vertex_attribute(counter, 'course')
    print course
    keys_in_course = list(assembly.network.vertices_where({'course': course}))
    elements = [assembly.element(key) for key in keys_in_course]
    for element in elements:
        artist = MeshArtist(element.mesh)
        mesh = artist.draw_mesh()
        G_course.append(mesh)

if show_connections:
    #elements = [assembly.element(key) for key in keys]
    #lines = assembly.network.to_lines() #does not work because edges are not transformed!
    G_connections = []
    edges = list(assembly.connections())
    for e in edges:
        p1 = assembly.element(e[0]).frame.point
        p2 = assembly.element(e[1]).frame.point
        G_connections += [rg.Line(p1[0],p1[1],p1[2],p2[0],p2[1],p2[2])]

if show_sequencing:
    from climate_active_bricks.assembly.sequencing import assembly_building_sequence
    sequ = assembly_building_sequence(assembly, counter)
    print sequ 
    G_sequence = []
    elements = [assembly.element(key) for key in sequ]
    for element in elements:
        artist = MeshArtist(element.mesh)
        mesh = artist.draw_mesh()
        G_sequence.append(mesh)
# ---------- end draw_2 ----------
geo_2 = Geometry(draw_2.G_element)
geo_3 = Geometry(draw_2.G_neighbors)
geo_4 = Geometry(draw_2.G_connections)
geo_5 = Geometry(draw_2.G_sequence)
geo_6 = Geometry(draw_2.G_course)
preview_3 = CustomPreview(Geometry=geo_3, Shader=ColourSwatch(SwatchColor=RGB(255, 212, 212)))
preview_4 = CustomPreview(Geometry=geo_4, Shader=ColourSwatch(SwatchColor=RGB(0, 0, 0)))
preview_5 = CustomPreview(Geometry=geo_2, Shader=ColourSwatch(SwatchColor=RGB(255, 143, 143)))
preview_6 = CustomPreview(Geometry=geo_6, Shader=ColourSwatch(SwatchColor=RGB(255, 204, 0)))
preview_7 = CustomPreview(Geometry=geo_5, Shader=ColourSwatch(SwatchColor=RGBA(255, 221, 135, 22)))
