# Grasshopper definition ex1_assembly.ghx (Grasshopper 1.0.7)

panel = Panel("Reload libraries")
bang = Button()
unload = PythonScript(bang=bang)
# ---------- unload: Python ----------
from compas_rhino.utilities.misc import get_tolerance
from compas_rhino.utilities.misc import unload_modules

unload_modules("compas")
unload_modules("compas_fab")
unload_modules("ur_online_control")
unload_modules("climate_active_bricks")
unload_modules("assembly_information_model")
# ---------- end unload ----------

py = PythonScript()  # -> HERE, DATA
# ---------- py: Python ----------
import os

HERE = os.path.dirname(ghdoc.Path)
DATA = os.path.abspath(os.path.join(HERE, "..", "data"))
print(HERE)
print(DATA)
# ---------- end py ----------

# ----
# Element
# Predefine a brick element and its dimensions
# Visualise the defined element
show = BooleanToggle(False)
elem_def = GhPythonScript()  # -> out, elem_full, elem_half
# ---------- elem_def: Python ----------
import os
import sys
import json

from compas.geometry import Frame
from compas.geometry import Vector
from compas.geometry import Box
from compas_fab.robots import Configuration

from assembly_information_model.assembly import Element


# dimensions full brick
width = 0.115
length = 0.240
height = 0.050

elem_full = Element.from_dimensions(length, width, height)
elem_full.tool_frame = Frame([0, 0, height], [1, 0, 0], [0, -1, 0])

elem_half = Element.from_dimensions(length/2, width, height)
elem_half.tool_frame = Frame([0, 0, height], [1, 0, 0], [0, -1, 0])
# ---------- end elem_def ----------
draw = PythonScript(elem_full=elem_def.elem_full, elem_half=elem_def.elem_half, show=show)  # -> M, F, S
# ---------- draw: Python ----------
from compas.geometry import Transformation
from compas.geometry import Frame
from compas.datastructures import mesh_transformed
from compas_ghpython.artists import MeshArtist
from compas_ghpython import draw_frame

if show:
    artist = MeshArtist(elem_full.mesh)
    M = [artist.draw_mesh()]
    F = [draw_frame(elem_full.frame)]
    #S = [draw_frame(elem_full._source.frame)]
    S = [draw_frame(elem_full.tool_frame)]
    
    
    artist = MeshArtist(elem_half.mesh)
    M += [artist.draw_mesh()]
    F += [draw_frame(elem_half.frame)]
    #S += [draw_frame(elem_half._source.frame)]
    S = [draw_frame(elem_half.tool_frame)]
# ---------- end draw ----------

export = Button()

list = ValueList({"20", "50", "100", "500", "1000", "5000"}, selected="50")
back = Button()
reset = Button()
start = Button()
stop = Button()
step = Button()
full = Button()

# ----
# Assembly
y_axis = Curve(<curve referenced from the Rhino model>)
x_axis = Curve(<curve referenced from the Rhino model>)
plane = PythonScript(plane_axes=[x_axis, y_axis])  # -> plane; inputs plane_axes: list of Curve
# ---------- plane: Python ----------
import Rhino.Geometry as rg

x_axis, y_axis = plane_axes

x_axis = rg.Line(x_axis.PointAtStart, x_axis.PointAtEnd)
y_axis = rg.Line(y_axis.PointAtStart, y_axis.PointAtEnd)

if x_axis.From.DistanceTo(y_axis.From) < 0.01:
    origin = x_axis.From
    xvec = x_axis.Direction
    yvec = y_axis.Direction
elif x_axis.To.DistanceTo(y_axis.To) < 0.01:
    origin = x_axis.To
    xvec = -x_axis.Direction
    yvec = -y_axis.Direction
elif x_axis.From.DistanceTo(y_axis.To) < 0.01:
    origin = x_axis.From
    xvec = x_axis.Direction
    yvec = -y_axis.Direction
elif x_axis.To.DistanceTo(y_axis.From) < 0.01:
    origin = x_axis.To
    xvec = -x_axis.Direction
    yvec = y_axis.Direction

plane = rg.Plane(origin, xvec, yvec)
# ---------- end plane ----------
cp_new = Plane(plane)

# ----
# to JSON
export_2 = Button()

# ----
# Ex1
pt = Point([<point referenced from the Rhino model> x3])
show_2 = BooleanToggle(True)
show_3 = BooleanToggle(False)

generate_assembly = GhPythonScript(elem_full=elem_def.elem_full, elem_half=elem_def.elem_half, transform=Toggle(False), ptransf=cp_new, attr_pts=pt)  # -> assembly; inputs ptransf: Plane, attr_pts: list of Point3d
# ---------- generate_assembly: Python ----------
import Rhino.Geometry as rg
import math
from scriptcontext import sticky as st


from compas.geometry import Frame
from compas.geometry import Transformation
from compas.geometry import Rotation
from compas.geometry import Translation
from compas.geometry import Point

from compas_ghpython.geometry import xtransformed
from compas_ghpython import draw_frame

from assembly_information_model.assembly import Assembly

import Rhino.Geometry as rg



length, width, height = [elem_full._source.xsize, elem_full._source.ysize, elem_full._source.zsize]
#print(width, length, height)

COURSES = 25
BRICKS_PER_COURSE = 10

MORTAR_PERPENDS = 0.025


total_length = BRICKS_PER_COURSE * length + (BRICKS_PER_COURSE - 1) * MORTAR_PERPENDS
gap_even = MORTAR_PERPENDS
gap_uneven = MORTAR_PERPENDS
gap_uneven = (total_length - (BRICKS_PER_COURSE * (length)))/BRICKS_PER_COURSE


assembly = Assembly() # initialize an empty assembly class
planes = [] # just for vizualisation


for course in range(COURSES):
    dy = course * height
    half_brick_ends = course % 2 != 0
    gap = gap_even if course % 2 == 0 else gap_uneven
    dx = 0

    bricks_in_course = BRICKS_PER_COURSE + (1 if half_brick_ends else 0)
    for j in range(bricks_in_course):

        first = j == 0
        last = j == bricks_in_course - 1

        is_half_brick = (first or last) and half_brick_ends

        if is_half_brick:
            if last:
                T = Translation([dx - width/2, 0, dy])
            else:
                T = Translation([dx - width/2-gap/2, 0, dy])
            e = elem_half.transformed(T)
            dx += width+gap/2
        else:
            T = Translation([dx, 0, dy])
            e = elem_full.transformed(T)
            dx += length
        
        cpt = e.frame.point
        
        #apply rotation to the bricks according to the distance of the attractor points
        min_dist = 10
        for attr_pt in attr_pts:
            dist =  attr_pt.DistanceTo(rg.Point3d(cpt.x, cpt.y, cpt.z))
            if dist<min_dist:
                min_dist = dist
            #print dist
        dist = min_dist
        R = Rotation.from_axis_and_angle([0,0,1], math.radians(1/(0.3*dist*dist)), point=e.frame.point) 
        e.transform(R)
        
        planes.append(draw_frame(e.tool_frame)) #only forvisualizing in gh
        
        assembly.add_element(e, course=course)
        dx += gap

if transform:
    T = Transformation.from_frame_to_frame(Frame.worldXY(), Frame(ptransf.Origin, ptransf.XAxis, ptransf.YAxis))
    assembly.transform(T)
# ---------- end generate_assembly ----------

export_3 = PythonScript(DATA=py.DATA, assembly=generate_assembly, export_to_json=export_2, export_to_json_unity=export)
# ---------- export_3: Python ----------
import os
from compas.datastructures.mesh import mesh_quads_to_triangles
from compas.datastructures.mesh import mesh_unify_cycles

if export_to_json:
    
    filename = "brickwall_ex1.json"
    PATH = os.path.join(DATA, filename)
    
    # the assembly has to be serialized such that it can be called from CPython
    assembly.to_json(PATH)
    

if export_to_json_unity:
    
    for key, e in assembly.elements():
    
        #convert to trimesh
        mesh_quads_to_triangles(e._mesh, check_angles=False)
        #mesh_unify_cycles(e._mesh)
        #print e._mesh.faces
        #print e._mesh.face_vertices(list(e._mesh.faces())[0])

    filename = "brickwall_ex1_unity.json"
    PATH = os.path.join(DATA, filename)
    assembly.to_json(PATH)
# ---------- end export_3 ----------

# ----
# Draw
panel_2 = Panel("Assembly Visualization")
counter = CountThroughList(assembly=generate_assembly, start=start, stop=stop, step=step, step_back=back, reset=reset, full=full, interval=list)  # -> item, counter; inputs start: Boolean, stop: Boolean, step_back: Boolean
# ---------- counter: Python ----------
from scriptcontext import sticky as st
from compas_ghpython import update_component


L = list(assembly.elements())
# store data in component
guid = str(ghenv.Component.InstanceGuid)
counter_key = "counter_" + guid
running_key = "running_" + guid

if counter_key not in st:
    st[counter_key] = 0

if running_key not in st:
    st[running_key] = False
    

if st[running_key]:
    if st[counter_key] < len(L) - 1:
        st[counter_key] += 1
        update_component(ghenv, interval)
    else:
        st[counter_key] = 0
        st[running_key] = False
    
    
if start:
    st[running_key] = True

if stop:
    st[running_key] = False

if step:
    if st[counter_key] < len(L) - 1:
        st[counter_key] += 1

if step_back:
    if st[counter_key] < len(L) - 1:
        st[counter_key] -= 1

if reset:
    st[counter_key] = 0

if full:
    st[counter_key] = len(L)-1

if len(L):
    item = L[st[counter_key]]



#st["visualisation_counter"] = st[counter_key]
#st[counter_key]= 50
counter = st[counter_key]
# ---------- end counter ----------
idx = Panel(counter.counter)

# ---- group: Network Connectivity Preview
show_4 = BooleanToggle(True)
show_5 = BooleanToggle(False)
draw_2 = PythonScript(
    assembly=generate_assembly,
    current_key=idx,
    show_current_element=show_4,
    show_course=show_5,
    show_all=show_2,
    show_until_key=show_3)  # -> G_element, G_elements, G_course, current_tool_plane; inputs current_key: Int32
# ---------- draw_2: Python ----------
import os
import sys

import math

import Rhino.Geometry as rg

from compas_ghpython.artists import MeshArtist
from compas_ghpython import draw_frame


G_element = []
G_elements = []
G_course = []

key_index = assembly.network.key_index()
keys = [key_index[key] for key in assembly.network.nodes()]

if show_current_element:
    element = assembly.element(current_key)
    artist = MeshArtist(element.mesh)
    mesh = artist.draw_mesh()
    G_element.append(mesh)

if show_course:
    course = assembly.network.node_attribute(key=current_key, name='course')
    keys_in_course = list(assembly.network.nodes_where({'course': course}))
    elements = [assembly.element(key) for key in keys_in_course]
    for element in elements:
        artist = MeshArtist(element.mesh)
        mesh = artist.draw_mesh()
        G_course.append(mesh)

if show_all and not show_until_key:
    elements = [assembly.element(key) for key in keys]
    for element in elements:
        artist = MeshArtist(element.mesh)
        mesh = artist.draw_mesh()
        G_elements.append(mesh)

if show_until_key:
    elements = [assembly.element(key) for key in keys]
    for element in elements[0:current_key+1]:
        artist = MeshArtist(element.mesh)
        mesh = artist.draw_mesh()
        G_elements.append(mesh)

tool_planes_WCS = [draw_frame(e.tool_frame) for e in elements]
current_tool_plane = tool_planes_WCS[current_key]
# ---------- end draw_2 ----------
geo = Geometry(draw_2.G_course)
geo_2 = Geometry(draw_2.G_element)
preview = CustomPreview(Geometry=geo_2, Shader=ColourSwatch(SwatchColor=RGB(255, 143, 143)))
preview_2 = CustomPreview(Geometry=geo, Shader=ColourSwatch(SwatchColor=RGB(255, 204, 0)))

# ----
pln = Plane(draw_2.current_tool_plane)

geo_3 = Geometry(draw_2.G_elements)
preview_3 = CustomPreview(Geometry=geo_3, Shader=ColourSwatch(SwatchColor=RGB(255, 255, 255)))
