# Grasshopper definition ex5_assembly_fabrication - endeffector.gh (Grasshopper 1.0.7)

panel = Panel("Reload libraries")
bang = Button()
unload = PythonScript(bang=bang)
# ---------- unload: Python ----------
from compas_rhino.utilities.misc import get_tolerance
from compas_rhino.utilities.misc import unload_modules

unload_modules("compas")
unload_modules("compas_fab")
unload_modules("ur_online_control")
unload_modules("climate_active_bricks")
unload_modules("assembly_information_model")
# ---------- end unload ----------

# ----
# Element
# Predefine a brick element and its dimensions
# Visualise the defined element
show = BooleanToggle(False)
elem_def = GhPythonScript()  # -> out, elem_full, elem_half
# ---------- elem_def: Python ----------
import os
import sys
import json

from compas.geometry import Frame
from compas.geometry import Vector
from compas.geometry import Box
from compas_fab.robots import Configuration

from assembly_information_model.assembly import Element


# dimensions full brick
width = 0.115
length = 0.240
height = 0.050

elem_full = Element.from_dimensions(length, width, height)
elem_full.tool_frame = Frame([0, 0, height], [1, 0, 0], [0, -1, 0])

elem_half = Element.from_dimensions(length/2, width, height)
elem_half.tool_frame = Frame([0, 0, height], [1, 0, 0], [0, -1, 0])
# ---------- end elem_def ----------
draw = PythonScript(elem_full=elem_def.elem_full, elem_half=elem_def.elem_half, show=show)  # -> M, F, S
# ---------- draw: Python ----------
from compas.geometry import Transformation
from compas.geometry import Frame
from compas.datastructures import mesh_transformed
from compas_ghpython.artists import MeshArtist
from compas_ghpython import draw_frame

if show:
    artist = MeshArtist(elem_full.mesh)
    M = [artist.draw_mesh()]
    F = [draw_frame(elem_full.frame)]
    #S = [draw_frame(elem_full._source.frame)]
    S = [draw_frame(elem_full.tool_frame)]
    
    
    artist = MeshArtist(elem_half.mesh)
    M += [artist.draw_mesh()]
    F += [draw_frame(elem_half.frame)]
    #S += [draw_frame(elem_half._source.frame)]
    S = [draw_frame(elem_half.tool_frame)]
# ---------- end draw ----------

# ----
# Settings
# --> Set your IP address
# --> Set robot IP address
server_ip = ValueList({"192.168.10.44", "192.168.10.12", "192.168.10.11", "192.168.10.10", "192.168.10.2", "127.0.0.1", "192.168.10.111"}, selected="192.168.10.11")
ur_ip = ValueList({"192.168.10.10", "192.168.10.20", "192.168.10.11", "192.168.10.12", "127.0.0.1", "192.168.10.111"}, selected="192.168.10.10")
server_port = ValueList({"50002", "50003", "50004", "50005"}, selected="50002")
ur_port = ValueList({"30002"}, selected="30002")
globals = PythonScript(server_address=server_ip, server_port=server_port, ur_ip=ur_ip, ur_port=ur_port, clear=Button())  # inputs server_port: Int32
# ---------- globals: Python ----------
from scriptcontext import sticky as st

st["server_address"] = server_address
st["server_port"] = server_port

st["ur_ip"] = ur_ip
st["ur_port"] = ur_port

if clear:
    st.clear()
# ---------- end globals ----------

# ----
# Check if UR robot
#  is available
ping = Button()
py = PythonScript(ip=ur_ip, ping=ping)  # -> out, trigger
# ---------- py: Python ----------
from scriptcontext import sticky as st
from ur_online_control.ur_direct import is_available

guid = str(ghenv.Component.InstanceGuid)
txt_key = "txt_" + guid
if txt_key not in st:
    st[txt_key] = ""

if ping:
    
    available = is_available(ip)
    
    if available:
        st[txt_key] = "%s is up!" % ip
        trigger = True
    else:
        st[txt_key] = "%s is down!" % ip
        trigger = False

print(st[txt_key])
# ---------- end py ----------
panel_2 = Panel(py.out)

list = ValueList({"20", "50", "100", "500", "1000", "5000"}, selected="50")
back = Button()
reset = Button()
start = Button()
stop = Button()
step = Button()
full = Button()

# ---- group: Robot_1
# 1. load robot model
# 2. set tool
# 3. set basis
# Here, you can set the basis for your robot
list_2 = ValueList({"no_tool": 0, "measurement_tool": 1, "air_pick 40mm": 2, "air_pick 15mm": 3, "air_pick 50mm": 4}, selected="air_pick 50mm")
y_axis = Curve(<curve referenced from the Rhino model>)
x_axis = Curve(<curve referenced from the Rhino model>)
list_3 = ValueList({"UR5", "UR10", "UR10e"}, selected="UR10e")
robot = PythonScript(model=list_3)  # -> robot
# ---------- robot: Python ----------
from ur_online_control.ur.ur10e import UR10e
from ur_online_control.ur.ur10 import UR10
from ur_online_control.ur.ur5 import UR5

from scriptcontext import sticky as st


if model == "UR5":
    robot = UR5()
if model == "UR10":
    robot = UR10()
if model == "UR10e":
    robot = UR10e()
# ---------- end robot ----------
tools = Tools(tool_id=list_2)
plane = PythonScript(plane_axes=[x_axis, y_axis])  # -> plane; inputs plane_axes: list of Curve
# ---------- plane: Python ----------
import Rhino.Geometry as rg

x_axis, y_axis = plane_axes

x_axis = rg.Line(x_axis.PointAtStart, x_axis.PointAtEnd)
y_axis = rg.Line(y_axis.PointAtStart, y_axis.PointAtEnd)

if x_axis.From.DistanceTo(y_axis.From) < 0.01:
    origin = x_axis.From
    xvec = x_axis.Direction
    yvec = y_axis.Direction
elif x_axis.To.DistanceTo(y_axis.To) < 0.01:
    origin = x_axis.To
    xvec = -x_axis.Direction
    yvec = -y_axis.Direction
elif x_axis.From.DistanceTo(y_axis.To) < 0.01:
    origin = x_axis.From
    xvec = x_axis.Direction
    yvec = -y_axis.Direction
elif x_axis.To.DistanceTo(y_axis.From) < 0.01:
    origin = x_axis.To
    xvec = -x_axis.Direction
    yvec = y_axis.Direction

plane = rg.Plane(origin, xvec, yvec)
# ---------- end plane ----------
base = PythonScript(base_plane=plane)  # -> base_frame, base_plane
# ---------- base: Python ----------
from compas.geometry import Frame
from compas.geometry import Transformation, Rotation
from compas_ghpython import draw_frame
import math
import Rhino.Geometry as rg


"""
origin = [0,0,0]
xaxis = [1,0,0]
yaxis = [0,1,0]

base_frame = Frame(list(origin), list(xaxis), list(yaxis))
"""

bp = base_plane
base_frame = Frame(bp.Origin, bp.XAxis, bp.YAxis)

#bf = Frame(bp.Origin, bp.XAxis, bp.YAxis)
#T = Transformation.change_basis(Frame.worldXY(), bf)
#base_frame = Frame.worldXY()
#base_frame.transform(T)
# ---------- end base ----------
set_params = PythonScript(robot=robot, tool=tools, base_frame=base.base_frame)  # -> robot
# ---------- set_params: Python ----------
from ur_online_control.ur.ur10e import UR10e
from scriptcontext import sticky as st
from ur_online_control.ur.tool import Tool
from compas.geometry import Frame


if tool:
    robot.set_tool(tool)
else:
    robot.set_tool(Tool(Frame.worldXY()))  
if base_frame:
    robot.set_base(base_frame)

st["robot"] = robot
# ---------- end set_params ----------

# ----
# Fabrication
number_slider = Slider(100, range=0..300)
send_single_task = Button()
exit_at_index = BooleanToggle(False)
stop_server = Button()
stop_robot = Button()
set_tasks = Button()
start_2 = Button()
init = Button()
fabricate = GhPythonScript(
    dfillet=Slider(20, range=0..100),
    speed=number_slider,
    speed_mod=Slider(2, range=0..10),
    init=init,
    set_tasks=set_tasks,
    start=start_2,
    stop_robot=stop_robot,
    stop_server=stop_server,
    send_single_task=send_single_task,
    exit_at_index=exit_at_index,
    exit_index=Slider(1, range=0..10))  # -> out, log, msgs, task, srv; inputs speed_mod: Int32, stop_robot: Boolean, exit_index: Int32, index: Int32
# ---------- fabricate: Python ----------
from scriptcontext import sticky as st
import ur_online_control.ur_direct as urd
from compas_ghpython import update_component
from ur_online_control.ur_direct import URCommandScript
from ur_online_control.communication.tcp_server import TCPFeedbackServer
from ur_online_control.fabrication_process import Fabrication

def get_robot(n):
    if n in [1,2]:
        ur_ip = st["ur_ip"]
        robot = st["robot"]
        return ur_ip, robot
        
def get_radius(i, frames, buffer = 0.7):
    if i == 1 or i == len(frames) - 3 or i == len(frames)-1:
        radius = 0.
    else:
        prev, current, next = frames[i-1].point, frames[i].point, frames[i+1].point
        radius = min((prev - current).length/2 * buffer, (next - current).length/2 * buffer, dfillet)
    return radius

def get_velocity(i, frames):
    if i == len(frames) - 3 or i == 1:
        speedval = speed/speed_mod
    else:
        speedval = speed
    return speedval

def get_move_commands(frames, robot):
    movel_commands = []
    for i, frame_WCS in enumerate(frames):
        frame_RCS = robot.get_frame_in_RCS(frame_WCS)
        radius = get_radius(i, frames)
        velocity = get_velocity(i, frames)
        cmd = list(frame_RCS.point) + list(frame_RCS.axis_angle_vector) + [velocity, radius]
        movel_commands.append(cmd)
    return movel_commands

server_ip = st["server_address"]
server_port = st["server_port"]
ur_port = st["ur_port"]
ur_ip, robot = get_robot(1)

def get_ur_script(key, element, data):
    ur_ip, robot = get_robot(data['robot'])
    move_commands = get_move_commands(element.trajectory, robot)
    tool_angle_axis = list(robot.tool.tcp_frame.point) + list(robot.tool.tcp_frame.axis_angle_vector)
    ur_script = URCommandScript(server_ip=server_ip, server_port=server_port, ur_ip=ur_ip, ur_port=ur_port)
    ur_script.start()
    ur_script.add_airpick_commands()
    ur_script.set_tcp(tool_angle_axis)
    for i, move_command in enumerate(move_commands):
        if i == 2:
            ur_script.airpick_on(max_vac=75, min_vac=25)
        elif i == 5:
            ur_script.airpick_off(pressure=55, timeout=5)
        else:
            pass
        ur_script.add_move_linear(move_command, feedback="Full")
    ur_script.end(feedback=True)
    ur_script.generate()
    if exit_at_index:
        ur_script.exit_message = move_commands[exit_index][:6]
    return ur_script

def create_tasks():
    return [get_ur_script(key,element,data) for key, element, data in assembly.elements(data=True) if key >= index]


class Fabrication_UR(Fabrication):
    def perform_task(self, task):
        self.log("TASK START: ---->>>>>")
        task.send_script()
        ok = self.server.listen(task.exit_message, 50)
        self.log(task.received_messages)
        if not ok:
            self.log("----<<<<< TASK FAILED")
            return False
        self.log("----<<<<< TASK FINISHED")
        return True

if init:
    fabrication = Fabrication_UR()
    server = TCPFeedbackServer()
    server.start()

if set_tasks:
    tasks = create_tasks()
    fabrication.clear_tasks()
    fabrication.set_tasks(tasks)

if stop_server:
    print("closing server...")
    server.close()
    server.join()
    print("server joined")

if start:
    fabrication.start(server)

if stop_robot:
    urd.stop(ur_ip, ur_port)
    fabrication.is_paused

if send_single_task:
    rt = fabrication.perform_task(fabrication.tasks[0])
    print(rt)
    if rt:
        urd.stop(ur_ip, ur_port)

try:
    srv = server
    fab = fabrication
except NameError:
    srv = None
    fab = None
else:
    if len(fabrication.tasks) > 0:
        msgs = [str(task.exit_message) for task in fabrication.tasks]
        task = fabrication.tasks[0]
    log = fabrication.log_messages
# ---------- end fabricate ----------

# ---- group: forward kinematics
a1 = Slider(0, range=-360..360)
a2 = Slider(-90, range=-360..360)
a4 = Slider(-90, range=-360..360)
a5 = Slider(-90, range=-360..360)
a3 = Slider(90, range=-360..360)
a6 = Slider(90, range=-360..360)
set_joint_values = BooleanToggle(True)
jp = GhPythonScript()  # -> joint_values
# ---------- jp: Python ----------
import math
joint_values = [-3.136, -0.328, -1.218, 3.129, 0.852, 0.008]
#joint_positions = [0] * 6

joint_values = [0,-90,90,-90,-90,90]
joint_values = [math.radians(a) for a in joint_values]
print joint_values
# ---------- end jp ----------
forward_kinematics = PythonScript(set_joint_vals=set_joint_values, joint_values=jp, a1=a1, a2=a2, a3=a3, a4=a4, a5=a5, a6=a6)  # -> configuration; inputs joint_values: list
# ---------- forward_kinematics: Python ----------
import math
import Grasshopper
from ur_online_control.ur.configuration import Configuration

if set_joint_vals:
    j = 0
    for i in range(ghenv.Component.Params.Input.Count):
        nslider = ghenv.Component.Params.Input[i].Sources[0]
        if nslider.GetType() == Grasshopper.Kernel.Special.GH_NumberSlider:
            nslider.TrySetSliderValue(math.degrees(joint_values[j]))
            j += 1

joint_values = [a1, a2, a3, a4, a5, a6]
configuration = Configuration.from_revolute_values([math.radians(d) for d in joint_values])
# ---------- end forward_kinematics ----------

# ----
list_4 = ValueList({"20", "50", "100", "500", "1000", "5000"}, selected="50")
reset_2 = Button()
back_2 = Button()
start_3 = Button()
stop_2 = Button()
step_2 = Button()
full_2 = Button()

get = Button()
pose = PythonScript(get=get)  # -> pose_cartesian
# ---------- pose: Python ----------
from scriptcontext import sticky as st
import ur_online_control.ur_direct as urd

server_address = st["server_address"]
server_port = st["server_port"]
ur_port = st["ur_port"]
ur_ip = st["ur_ip"]
robot = st["robot"]
tool_angle_axis = list(robot.tool.tcp_frame.point) + list(robot.tool.tcp_frame.axis_angle_vector)
print(tool_angle_axis)

guid = str(ghenv.Component.InstanceGuid)
pose_cartesian_key = "pose_cartesian" + guid


if get:
    st[pose_cartesian_key] = urd.get_current_pose_cartesian(tool_angle_axis, server_address, server_port, ur_ip, ur_port, send=True)

if pose_cartesian_key not in st:
    pose_cartesian = []
else:
    pose_cartesian = st[pose_cartesian_key]

print(pose_cartesian)
# ---------- end pose ----------
py_2 = PythonScript(pose_cartesian=pose)  # -> frame_WCS, plane_WCS; inputs pose_cartesian: list
# ---------- py_2: Python ----------
import Rhino.Geometry as rg
from scriptcontext import sticky as st
from compas.geometry import Frame
from compas.geometry import Transformation
from compas_ghpython import draw_frame

robot = st["robot"]
pose = pose_cartesian

if pose_cartesian:
    #frame_RCS = Frame.from_pose_axis_angle_vector(pose_cartesian)
    frame_RCS = Frame.from_axis_angle_vector(axis_angle_vector=pose[3:], point=pose[:3])
    frame_WCS = robot.get_frame_in_WCS(frame_RCS)
    plane_WCS  = draw_frame(frame_WCS)
    print frame_RCS
# ---------- end py_2 ----------
# Direct UR control
panel_3 = Panel("get pose cartesian")
draw_2 = Draw(frame=py_2.frame_WCS)  # -> G, C
panel_4 = Panel(pose)
preview = CustomPreview(Geometry=draw_2.G, Shader=draw_2.C)

get_2 = Button()
pose_2 = PythonScript(get=get_2)  # -> configuration, pose_joints
# ---------- pose_2: Python ----------
from scriptcontext import sticky as st
import ur_online_control.ur_direct as urd
from ur_online_control.ur.configuration import Configuration

server_address = st["server_address"]
server_port = st["server_port"]
ur_port = st["ur_port"]
ur_ip = st["ur_ip"]
robot = st["robot"]
tool_angle_axis = list(robot.tool.tcp_frame.point) + list(robot.tool.tcp_frame.axis_angle_vector)
print(tool_angle_axis)

guid = str(ghenv.Component.InstanceGuid)
pose_joints_key = "pose_joints" + guid


if get:
    st[pose_joints_key] = urd.get_current_pose_joints(tool_angle_axis, server_address, server_port, ur_ip, ur_port, send=True)
if pose_joints_key not in st:
    #pose_joints = Configuration.from_revolute_values([0,0,0,0,0,0])
    configuration = Configuration.from_revolute_values([0,0,0,0,0,0])
else:
    #pose_joints = Configuration.from_revolute_values(st[pose_joints_key])
    configuration = Configuration.from_revolute_values(st[pose_joints_key])

pose_joints = configuration.values
# ---------- end pose_2 ----------
panel_5 = Panel("get pose joint")
panel_6 = Panel(pose_2.pose_joints)

panel_7 = Panel("reorient tool vertical")
movel = PythonScript()  # -> script
# ---------- movel: Python ----------
import math
from scriptcontext import sticky as st
import ur_online_control.ur_direct as urd

server_address = st["server_address"]
server_port = st["server_port"]
robot = st["robot"]
tool_angle_axis = list(robot.tool.tcp_frame.point) + list(robot.tool.tcp_frame.axis_angle_vector)

commands = urd.URCommandScript(server_address, server_port)
commands.start()
commands.set_tcp(tool_angle_axis)
commands.get_current_pose_cartesian()
commands.add_line("\tmovel(p[current_pose[0], current_pose[1], current_pose[2], {}, {}, {}], a=0.1, v=0.1)".format(math.pi, 0, 0))
commands.end()
script = commands.generate()

print(script)
# ---------- end movel ----------
send = Button()
send_2 = GhPythonScript(script=movel, send=send)  # -> out; inputs send: Boolean
# ---------- send_2: Python ----------
from scriptcontext import sticky as st
from ur_online_control.ur_direct import send_script

ur_ip = st["ur_ip"]
ur_port = st["ur_port"]

if send:
    send_script(script, ur_ip, ur_port)
# ---------- end send_2 ----------

panel_8 = Panel("stop")
stop_3 = Button()
stop_4 = PythonScript(stop=stop_3)
# ---------- stop_4: Python ----------
from scriptcontext import sticky as st
import ur_online_control.ur_direct as urd

ur_ip = st["ur_ip"]
ur_port = st["ur_port"]

if stop:
    urd.stop(ur_ip, ur_port)
# ---------- end stop_4 ----------

value = BooleanToggle(True)
panel_9 = Panel("set digital out")
number = Slider(1, range=0..10)
digital_out = PythonScript(number=number, value=value)  # -> script; inputs number: Int32, value: Boolean
# ---------- digital_out: Python ----------
import ur_online_control.ur_direct as urd

commands = urd.URCommandScript()
commands.start()
commands.add_line("\tset_digital_out({}, {})".format(number, value))
commands.end()
script = commands.generate()

print(script)
# ---------- end digital_out ----------
send_3 = Button()
send_4 = GhPythonScript(script=digital_out, send=send_3)  # -> out; inputs send: Boolean; same code as send_2

# ----
# Calculate basis
# Measure basis:
# 1. Clear the recorded poses
# 2. Move robot to origin and press "get pose"
# 3. Move robot to point in positive x-axis and press "get pose"
# 4. Move robot to an other point in your basis and press "get pose"
# (The further away these positions are, the better)
# 
# 5. Alternatively change the order in the component calc base
# 6. Copy output into base component (TODO: check if it has to be inverted)
list_5 = ValueList({"o, pos.x-axis, xy pl": 0, "o, pos.y-axis, xy pl": 1}, selected="o, pos.x-axis, xy pl")
clear = Button()
rec = PythonScript(msg=pose, rec=get, clear=clear)  # -> rec; inputs msg: list
# ---------- rec: Python ----------
from scriptcontext import sticky as st

guid = str(ghenv.Component.InstanceGuid)
recorded_key =  "recorded_" + guid
just_cleared_key = "just_cleared_" + guid


if recorded_key not in st:
    st[recorded_key] = []

if just_cleared_key not in st:
    st[just_cleared_key] = False

if clear:
    st[recorded_key] = []
    st[just_cleared_key] = True
else:
    if len(msg):
        if msg != [None] and not st[just_cleared_key] and rec:
            st[recorded_key].append(msg)
    st[just_cleared_key] = False
        


rec = st[recorded_key]

print rec
# ---------- end rec ----------
calc_base = PythonScript(poses=rec, input_type=list_5)  # -> out; inputs poses: list
# ---------- calc_base: Python ----------
import Rhino.Geometry as rg
import math


if len(poses) > 2:
    
    O = poses[0]
    P1 = poses[1]
    P2 = poses[2]
    
    if input_type == 0:
        # origin, pt on positive x-axis, pt in xy plane
        origin = rg.Point3d(O[0], O[1], O[2])
        pt_on_xaxis = rg.Point3d(P1[0], P1[1], P1[2])
        pt_in_xyplane = rg.Point3d(P2[0], P2[1], P2[2])
        
        xaxis = pt_on_xaxis - origin
        xaxis.Unitize()
        
        v = pt_in_xyplane - origin
        zaxis = rg.Vector3d.CrossProduct(v, xaxis)
        zaxis.Unitize()
        
        # zaxis must look up!
        if math.acos(rg.Vector3d.ZAxis * zaxis) > math.acos(rg.Vector3d.ZAxis * -zaxis):
            zaxis = -zaxis
        
        yaxis = rg.Vector3d.CrossProduct(zaxis, xaxis)
    
    elif input_type == 1:
        # origin, pt on positive y-axis, pt in xy plane
        origin = rg.Point3d(O[0], O[1], O[2])
        pt_on_yaxis = rg.Point3d(P1[0], P1[1], P1[2])
        pt_in_xyplane = rg.Point3d(P2[0], P2[1], P2[2])
        
        yaxis = pt_on_yaxis - origin
        yaxis.Unitize()
        
        v = pt_in_xyplane - origin
        zaxis = rg.Vector3d.CrossProduct(v, yaxis)
        zaxis.Unitize()
        
        # zaxis must look up!
        if math.acos(rg.Vector3d.ZAxis * zaxis) > math.acos(rg.Vector3d.ZAxis * -zaxis):
            zaxis = -zaxis
        
        xaxis = rg.Vector3d.CrossProduct(yaxis, zaxis)
        
        
    print "Copy the following into base component:"
    print " "
    print "origin = [%.2f, %.2f, %.2f]" % tuple(list(origin))
    print "xaxis = [%.5f, %.5f, %.5f]" % tuple(list(xaxis))
    print "yaxis = [%.5f, %.5f, %.5f]" % tuple(list(yaxis))
    

#print rg.Vector3d.CrossProduct(rg.Vector3d.YAxis, rg.Vector3d.ZAxis)
#print rg.Vector3d.CrossProduct(rg.Vector3d.ZAxis, rg.Vector3d.XAxis)
# ---------- end calc_base ----------
panel_10 = Panel(rec)
panel_11 = Panel(calc_base)

# ----
# move incremental in TCS
number_slider_2 = Slider(5, range=-10..10)
get_current_pose = Button()
list_6 = ValueList({"xaxis", "yaxis", "zaxis"}, selected="yaxis")
movel_2 = PythonScript(get=get_current_pose, step_size=number_slider_2, direction=list_6)  # -> script
# ---------- movel_2: Python ----------
from scriptcontext import sticky as st
from compas.geometry import Frame
from compas.geometry import Point, Vector
import ur_online_control.ur_direct as urd

server_address = st["server_address"]
server_port = st["server_port"]
ur_port = st["ur_port"]
ur_ip = st["ur_ip"]
robot = st["robot"]
tool_angle_axis = list(robot.tool.tcp_frame.point) + list(robot.tool.tcp_frame.axis_angle_vector)
x, y, z, ax, ay, az = tool_angle_axis
print(tool_angle_axis)

guid = str(ghenv.Component.InstanceGuid)
pose_cartesian_key = "pose_cartesian" + guid

if get:
    st[pose_cartesian_key] = urd.get_current_pose_cartesian(tool_angle_axis, server_address, server_port, ur_ip, ur_port, send=True)

if pose_cartesian_key not in st:
    pose_cartesian = []
    script = ""
else:
#    frame = Frame.from_pose_axis_angle_vector(pose_cartesian)
    frame = Frame.from_axis_angle_vector([ax, ay, az])
    frame.point = [x, y, z]
    
    def next_vector(direction, frame, step_size):
        dir_vector = {"xaxis": Vector(*frame.xaxis), "yaxis": Vector(*frame.yaxis), "zaxis": Vector(*frame.zaxis)}
        vector = dir_vector[direction] * step_size
        return vector
    
    [x, y, z] = next_vector(direction, frame, step_size)
    commands = urd.URCommandScript(server_address, server_port)
    commands.start()
    commands.set_tcp(tool_angle_axis)
    commands.get_current_pose_cartesian()
    commands.add_line("\tmovel(p[current_pose[0] + {}, current_pose[1] + {}, current_pose[2] + {}, current_pose[3], current_pose[4], current_pose[5]], t={})".format(x/1000, y/1000, z/1000, step_size * 0.1))
    commands.end()
    script = commands.generate()
    
    print(script)
# ---------- end movel_2 ----------
send_5 = Button()
send_6 = GhPythonScript(script=movel_2, send=send_5)  # -> out; inputs send: Boolean; same code as send_2

panel_12 = Panel("move cartesian single")
movel_3 = PythonScript()  # -> script; inputs plane_WCS: Plane
# ---------- movel_3: Python ----------
import Rhino.Geometry as rg
import ur_online_control.ur_direct as urd
from compas.geometry import Frame
from compas.geometry import Transformation
from compas_ghpython import draw_frame
from scriptcontext import sticky as st

robot = st["robot"]

frame_WCS = Frame(plane_WCS.Origin, plane_WCS.XAxis, plane_WCS.YAxis)
frame_RCS = robot.get_frame_in_RCS(frame_WCS)
cmd = list(frame_RCS.point) + list(frame_RCS.axis_angle_vector) + [20.0, 0.0]
tool_angle_axis = list(robot.tool.tcp_frame.point) + list(robot.tool.tcp_frame.axis_angle_vector)

commands = urd.generate_moves_linear(tool_angle_axis, cmd, st["ur_ip"], st["ur_port"])
script = commands.script
print(script)
# ---------- end movel_3 ----------
send_7 = Button()
send_8 = GhPythonScript(script=movel_3, send=send_7)  # -> out; inputs send: Boolean; same code as send_2

# ----
# send airpick vacuum scripts
send_9 = Button()
send_10 = Button()
send_11 = Button()
airpick = GhPythonScript(send_script_airpick_on=send_9, send_script_airpick_off=send_10, send_script_airpick_onoff=send_11)  # -> out; inputs send_script_airpick_on: Boolean
# ---------- airpick: Python ----------
import time
from scriptcontext import sticky as st
import ur_online_control.ur_direct as urd

ur_ip = st["ur_ip"]
ur_port = st["ur_port"]

script_on = urd.airpick_toggle(True, ur_ip, ur_port)
script_off = urd.airpick_toggle(False, ur_ip, ur_port)

if send_script_airpick_on:
    script_on.send_script()
    
if send_script_airpick_off:
    script_off.send_script()

if send_script_airpick_onoff:
    script_on.send_script()
    time.sleep(5)
    script_off.send_script()
# ---------- end airpick ----------

py_3 = PythonScript()  # -> HERE, DATA
# ---------- py_3: Python ----------
import os

HERE = os.path.dirname(ghdoc.Path)
DATA = os.path.abspath(os.path.join(HERE, "..", "data"))
print(HERE)
print(DATA)
# ---------- end py_3 ----------
pt = Point([<point referenced from the Rhino model> x3])
show_2 = BooleanToggle(True)
show_3 = BooleanToggle(True)

# ----
# Assembly
y_axis_2 = Curve(<curve referenced from the Rhino model>)
x_axis_2 = Curve(<curve referenced from the Rhino model>)
plane_2 = PythonScript(plane_axes=[x_axis_2, y_axis_2])  # -> plane; inputs plane_axes: list of Curve; same code as plane
cp_new = Plane(plane_2)
generate_assembly = GhPythonScript(elem_full=elem_def.elem_full, elem_half=elem_def.elem_half, transform=Toggle(True), ptransf=cp_new, attr_pts=pt)  # -> assembly; inputs ptransf: Plane, attr_pts: list of Point3d
# ---------- generate_assembly: Python ----------
import Rhino.Geometry as rg
import math
from scriptcontext import sticky as st


from compas.geometry import Frame
from compas.geometry import Transformation
from compas.geometry import Rotation
from compas.geometry import Translation
from compas.geometry import Point

from compas_ghpython.geometry import xtransformed
from compas_ghpython import draw_frame

from assembly_information_model.assembly import Assembly

import Rhino.Geometry as rg



length, width, height = [elem_full._source.xsize, elem_full._source.ysize, elem_full._source.zsize]
#print(width, length, height)

COURSES = 25
BRICKS_PER_COURSE = 4

MORTAR_PERPENDS = 0.025


total_length = BRICKS_PER_COURSE * length + (BRICKS_PER_COURSE - 1) * MORTAR_PERPENDS
gap_even = MORTAR_PERPENDS
gap_uneven = MORTAR_PERPENDS
gap_uneven = (total_length - (BRICKS_PER_COURSE * (length)))/BRICKS_PER_COURSE


assembly = Assembly() # initialize an empty assembly class
planes = [] # just for vizualisation


for course in range(COURSES):
    dy = course * height
    half_brick_ends = course % 2 != 0
    gap = gap_even if course % 2 == 0 else gap_uneven
    dx = 0

    bricks_in_course = BRICKS_PER_COURSE + (1 if half_brick_ends else 0)
    for j in range(bricks_in_course):

        first = j == 0
        last = j == bricks_in_course - 1

        is_half_brick = (first or last) and half_brick_ends

        if is_half_brick:
            if last:
                T = Translation([dx - width/2, 0, dy])
            else:
                T = Translation([dx - width/2-gap/2, 0, dy])
            e = elem_half.transformed(T)
            dx += width+gap/2
        else:
            T = Translation([dx, 0, dy])
            e = elem_full.transformed(T)
            dx += length
        
        cpt = e.frame.point
        
        #apply rotation to the bricks according to the distance of the attractor points
        min_dist = 10
        for attr_pt in attr_pts:
            dist =  attr_pt.DistanceTo(rg.Point3d(cpt.x, cpt.y, cpt.z))
            if dist<min_dist:
                min_dist = dist
            #print dist
        dist = min_dist
        R = Rotation.from_axis_and_angle([0,0,1], math.radians(1/(0.3*dist*dist)), point=e.frame.point) 
        e.transform(R)
        
        planes.append(draw_frame(e.tool_frame)) #only forvisualizing in gh
        
        typology = "half" if is_half_brick else "full"
        assembly.add_element(e, course=course, typology=typology)
        dx += gap

if transform:
    T = Transformation.from_frame_to_frame(Frame.worldXY(), Frame(ptransf.Origin, ptransf.XAxis, ptransf.YAxis))
    assembly.transform(T)
# ---------- end generate_assembly ----------

# ----
# Path Mapping
pup_half = Plane(Plane(origin=(-0.2594638955, 0.125, 0.05), x=(1, 0, 0), y=(0, -1, 0)))
pup_full = Plane(Plane(origin=(-0.3194638955, 0.25, 0.05), x=(1, 0, 0), y=(0, -1, 0)))
path_mapping = GhPythonScript(
    assembly=generate_assembly,
    elem_full=elem_def.elem_full,
    elem_half=elem_def.elem_half,
    pick_up_plane_WCS_full=pup_full,
    pick_up_plane_WCS_half=pup_half,
    base_frame=base.base_frame)  # -> out, path_planes, assembly, elem_pickup_full, elem_pickup_half; inputs pick_up_plane_WCS_full: Plane, pick_up_plane_WCS_half: Plane
# ---------- path_mapping: Python ----------
from scriptcontext import sticky as st
from compas.geometry import Frame, Translation, Transformation
from compas_ghpython import draw_frame
from compas_ghpython.artists import MeshArtist

import Rhino.Geometry as rg

from assembly_information_model.assembly import Assembly

""" Procedure 
00. Safe plane above pickup plane
10. Pickup plane
20. Safe plane above pickup plane
25. (optional) Transition planes to avoid self-collision
30. Safe plane above release plane
40. Release plane
50. Safe plane above pickup plane
"""

path_planes = []

pup_full = pick_up_plane_WCS_full
pup_half = pick_up_plane_WCS_half
pickup_frame_full = Frame(pup_full.Origin, pup_full.XAxis, pup_full.YAxis)
pickup_frame_half = Frame(pup_half.Origin, pup_half.XAxis, pup_half.YAxis)

#visualize full brick at pickup location
T = Transformation.from_frame(pickup_frame_full)
e = elem_full.transformed(T)

artist = MeshArtist(e.mesh)
elem_pickup_full = artist.draw_mesh()

#visualize half brick at pickup location
T = Transformation.from_frame(pickup_frame_half)
e = elem_half.transformed(T)

artist = MeshArtist(e.mesh)
elem_pickup_half = artist.draw_mesh()



safe_level = 0.250

#stack_num = 10
#y_loc = 0
#print list(pickup_frame.point) + list(pickup_frame.quaternion)

for key, element, data in assembly.elements(data=True):
    string_message = "This is the element with the key index %i" %key
    print string_message
    #print data
    
    if data['typology'] == "full":
        element_pickup = pickup_frame_full
    else:
        element_pickup = pickup_frame_half

    _10frame = element_pickup
    _40frame = element.tool_frame
    
    _00frame = _10frame.transformed(Translation(_10frame.zaxis*-safe_level))
    _20frame = _00frame
    
    _30frame = _40frame.transformed(Translation(_40frame.zaxis*-safe_level))
    _50frame = _30frame
    
    element.path = [_00frame, _10frame, _20frame, _30frame, _40frame, _50frame]
    tfs = [path_planes.append(draw_frame(frame)) for frame in element.path]
    #element.robot_base_frame = robot.base_frame
    
    #store also the robot origin in the attributes of the element
    #print assembly.data
    #data.update(robot_base_frame = base_frame.to_data())

#store also the robot origin in the attributes of the assembly
assembly.network.attributes.update(robot_base_frame = base_frame.to_data())
print assembly.network.attributes['robot_base_frame']
# ---------- end path_mapping ----------
pln = Plane(path_mapping.path_planes)
geo = Geometry([path_mapping.elem_pickup_full, path_mapping.elem_pickup_half])
preview_2 = CustomPreview(Geometry=geo, Shader=ColourSwatch(SwatchColor=RGB(255, 237, 237)))

# ----
# to JSON
export = Button()
export_2 = Button()
export_3 = PythonScript(DATA=py_3.DATA, assembly=generate_assembly, export_to_json=export, export_to_json_unity=export_2)
# ---------- export_3: Python ----------
import os
from compas.datastructures.mesh import mesh_quads_to_triangles
from compas.datastructures.mesh import mesh_unify_cycles

if export_to_json:
    
    filename = "brickwall_ex5.json"
    PATH = os.path.join(DATA, filename)
    
    # the assembly has to be serialized such that it can be called from CPython
    assembly.to_json(PATH)
    

if export_to_json_unity:
    
    for key, e in assembly.elements():
    
        #convert to trimesh
        mesh_quads_to_triangles(e._mesh, check_angles=False)
        #mesh_unify_cycles(e._mesh)
        #print e._mesh.faces
        #print e._mesh.face_vertices(list(e._mesh.faces())[0])

    filename = "brickwall_ex5_unity.json"
    PATH = os.path.join(DATA, filename)
    assembly.to_json(PATH)
# ---------- end export_3 ----------

# ----
# Draw
panel_13 = Panel("Assembly Visualization")
counter = CountThroughList(assembly=generate_assembly, start=start, stop=stop, step=step, step_back=back, reset=reset, full=full, interval=list)  # -> item, counter; inputs start: Boolean, stop: Boolean, step_back: Boolean
# ---------- counter: Python ----------
from scriptcontext import sticky as st
from compas_ghpython import update_component


L = list(assembly.elements())
# store data in component
guid = str(ghenv.Component.InstanceGuid)
counter_key = "counter_" + guid
running_key = "running_" + guid

if counter_key not in st:
    st[counter_key] = 0

if running_key not in st:
    st[running_key] = False
    

if st[running_key]:
    if st[counter_key] < len(L) - 1:
        st[counter_key] += 1
        update_component(ghenv, interval)
    else:
        st[counter_key] = 0
        st[running_key] = False
    
    
if start:
    st[running_key] = True

if stop:
    st[running_key] = False

if step:
    if st[counter_key] < len(L) - 1:
        st[counter_key] += 1

if step_back:
    if st[counter_key] < len(L) - 1:
        st[counter_key] -= 1

if reset:
    st[counter_key] = 0

if full:
    st[counter_key] = len(L)-1

if len(L):
    item = L[st[counter_key]]



#st["visualisation_counter"] = st[counter_key]
#st[counter_key]= 50
counter = st[counter_key]
# ---------- end counter ----------
idx = Panel(counter.counter)

# ---- group: Network Connectivity Preview
show_4 = BooleanToggle(True)
show_5 = BooleanToggle(False)
draw_3 = PythonScript(
    assembly=generate_assembly,
    current_key=idx,
    show_current_element=show_4,
    show_course=show_5,
    show_all=show_2,
    show_until_key=show_3)  # -> G_element, G_elements, G_course, current_tool_plane, current_path_planes; inputs current_key: Int32
# ---------- draw_3: Python ----------
import os
import sys

import math

import Rhino.Geometry as rg

from compas_ghpython.artists import MeshArtist
from compas_ghpython import draw_frame


G_element = []
G_elements = []
G_course = []

key_index = assembly.network.key_index()
keys = [key_index[key] for key in assembly.network.nodes()]

if show_current_element:
    element = assembly.element(current_key)
    artist = MeshArtist(element.mesh)
    mesh = artist.draw_mesh()
    G_element.append(mesh)

if show_course:
    course = assembly.network.node_attribute(key=current_key, name='course')
    keys_in_course = list(assembly.network.nodes_where({'course': course}))
    elements = [assembly.element(key) for key in keys_in_course]
    for element in elements:
        artist = MeshArtist(element.mesh)
        mesh = artist.draw_mesh()
        G_course.append(mesh)

if show_all and not show_until_key:
    elements = [assembly.element(key) for key in keys]
    for element in elements:
        artist = MeshArtist(element.mesh)
        mesh = artist.draw_mesh()
        G_elements.append(mesh)

if show_until_key:
    elements = [assembly.element(key) for key in keys]
    for element in elements[0:current_key+1]:
        artist = MeshArtist(element.mesh)
        mesh = artist.draw_mesh()
        G_elements.append(mesh)

tool_planes_WCS = [draw_frame(e.tool_frame) for e in elements]
current_tool_plane = tool_planes_WCS[current_key]
current_path_planes = [draw_frame(plane) for plane in assembly.element(current_key).path]
# ---------- end draw_3 ----------
geo_2 = Geometry(draw_3.G_element)
geo_3 = Geometry(draw_3.G_course)
preview_3 = CustomPreview(Geometry=geo_2, Shader=ColourSwatch(SwatchColor=RGB(255, 143, 143)))
preview_4 = CustomPreview(Geometry=geo_3, Shader=ColourSwatch(SwatchColor=RGB(255, 204, 0)))

# ----
geo_4 = Geometry(draw_3.G_elements)
pln_2 = Plane(draw_3.current_path_planes)
preview_5 = CustomPreview(Geometry=geo_4, Shader=ColourSwatch(SwatchColor=RGB(255, 255, 255)))

pln_3 = Plane(draw_3.current_tool_plane)

# ---- group: input
# Robot Visualisation
robot_2 = Data(set_params)
plane_wcs = Plane(pln_3)
planes_wcs = Plane(pln_2)

# ---- group: Calculate joint positions for path
idx_2 = Slider(5, range=0..7)
inverse_multiple = PythonScript(robot=robot_2, planes_WCS=planes_wcs, configuration_idx=idx_2)  # -> configurations; inputs planes_WCS: list, configuration_idx: Int32, init_configuration: list
# ---------- inverse_multiple: Python ----------
from compas_ghpython import unload_modules
unload_modules('ur_online_control')

import Rhino.Geometry as rg
from compas.geometry import Frame 
from compas.geometry import Transformation
from compas_ghpython import draw_frame
from ur_online_control.ur.kinematics import calculate_configurations_for_path, format_joint_positions


print init_configuration

# TODO this must be optimized! matrix multiplication!
frames_tool0_RCS = []
for plane_WCS in planes_WCS:
    tcp_WCS = Frame(plane_WCS.Origin, plane_WCS.XAxis, plane_WCS.YAxis)
    tcp_RCS = robot.get_frame_in_RCS(tcp_WCS)
    frames_tool0_RCS.append(robot.get_tool0_frame_from_tcp_frame(tcp_RCS))
    

#configurations = calculate_configurations_for_path(frames_tool0_RCS, robot.params, init_configuration)
configurations = calculate_configurations_for_path(frames_tool0_RCS, robot, init_configuration)
#print configurations
configurations = configurations[min([configuration_idx, len(configurations) - 1])]

def format(numbers, k=4):
    #numbers = format_joint_positions(numbers)
    return "[" + ", ".join([("%." + str(k) + "f") % n for n in numbers]) + "]"
# ---------- end inverse_multiple ----------
counter_2 = CountThroughList(
    L=inverse_multiple,
    start=start_3,
    stop=stop_2,
    step=step_2,
    step_back=back_2,
    reset=reset_2,
    full=full_2,
    interval=list_4)  # -> item, counter; inputs L: list, start: Boolean, stop: Boolean, step_back: Boolean
# ---------- counter_2: Python ----------
from scriptcontext import sticky as st
from compas_ghpython import update_component


# store data in component
guid = str(ghenv.Component.InstanceGuid)
counter_key = "counter_" + guid
running_key = "running_" + guid

if counter_key not in st:
    st[counter_key] = 0

if running_key not in st:
    st[running_key] = False

if start:
    st[running_key] = True

if stop:
    st[running_key] = False

if step:
    if st[counter_key] < len(L) - 1:
        st[counter_key] += 1

if step_back:
    if st[counter_key] < len(L) - 1:
        st[counter_key] -= 1

if reset:
    st[counter_key] = 0

if full:
    st[counter_key] = len(L)-1

if len(L):
    item = L[st[counter_key]]

if st[running_key]:
    if st[counter_key] < len(L) - 1:
        st[counter_key] += 1
        update_component(ghenv, interval)
    else:
        st[counter_key] = 0
        st[running_key] = False

#st["visualisation_counter"] = st[counter_key]
counter = st[counter_key]
# ---------- end counter_2 ----------

# ---- group: Define plane in WCS, calculate joint positions
select_configuration = Slider(5, range=0..7)
inverse = PythonScript(robot=robot_2, plane_WCS=plane_wcs, idx=select_configuration)  # -> configuration, plane_WCS; inputs plane_WCS: Plane, idx: Int32
# ---------- inverse: Python ----------
import Rhino.Geometry as rg
from compas.geometry import Frame, Transformation
from compas_ghpython import draw_frame
import math


tcp_WCS = Frame(plane_WCS.Origin, plane_WCS.XAxis, plane_WCS.YAxis)

# transform frame to robot coordinate system
tcp_RCS = robot.get_frame_in_RCS(tcp_WCS)
tool0_RCS = robot.get_tool0_frame_from_tcp_frame(tcp_RCS)

# calculate solutions to frame
solutions = robot.inverse_kinematics(tool0_RCS)

if not len(solutions):
    configuration = [0,0,0,0,0,0]
else:
    idx = min(len(solutions) - 1, idx)
    configuration = solutions[idx]
    
print(configuration)
# ---------- end inverse ----------

# ---- group: Visualise
# Choose from different options, which robot configuration to visualise
list_7 = ValueList({"0 forward, from angles": 0, "1 inverse, from one plane": 1, "2 inverse, from multiple planes": 2, "3 forward, from robot": 3}, selected="1 inverse, from one plane")
robots = Robots(model=list_3)  # -> robot_mesh_2, robot_brep_2
show_brep = BooleanToggle(False)
filter = StreamFilter(
    Gate=list_7,
    Stream0=forward_kinematics,
    Stream1=inverse.configuration,
    Stream2=counter_2.item,
    Stream3=pose_2.configuration)
draw_4 = PythonScript(robot=robot_2, configuration=filter, meshes=robots.robot_mesh_2, breps=robots.robot_brep_2, show_brep=show_brep)  # -> out, robot_mesh, tool_mesh, robot_brep, tool_brep, tool0_plane, tcp_plane; inputs meshes: list of Mesh, breps: list of Brep
# ---------- draw_4: Python ----------
from scriptcontext import sticky as st
from compas_ghpython import draw_frame


if configuration:
    if len(robot.model) == 0:
        robot.model = meshes
        robot.model_breps = breps
        #robot_brep, tool_brep, robot_mesh, tool_mesh = []
    
    tmodel = robot.xdraw(configuration)
    robot_mesh = tmodel[:6]
    tool_mesh = tmodel[6]
    
    if show_brep:
        tmodel = robot.xdraw_brep(configuration)
        robot_brep = tmodel[:6]
        tool_brep = tmodel[6]
        robot_mesh = []
        tool_mesh = []
    
    T0, T1, T2, T3, T4, T5 = robot.get_forward_transformations(configuration)

    tool0_frame, tcp_frame = robot.get_transformed_tool_frames(T5)
    tool0_plane = draw_frame(tool0_frame)
    tcp_plane = draw_frame(tcp_frame)
# ---------- end draw_4 ----------
tool_brep = Brep(draw_4.tool_brep)
tcp_plane = Plane(draw_4.tcp_plane)
tool_mesh = Mesh(draw_4.tool_mesh)
robot_brep = Brep(draw_4.robot_brep)
robot_mesh = Mesh(draw_4.robot_mesh)
tool0_plane = Plane(draw_4.tool0_plane)
draw_5 = RepresentPlaneAsLines(plane=[tcp_plane, tool0_plane], size=0.1)  # -> G, C
# ---------- draw_5: Python ----------
import Rhino.Geometry as rg
from System.Drawing import Color

if plane:

    G = []
    G.append(rg.Line(plane.Origin, size * plane.XAxis))
    G.append(rg.Line(plane.Origin, size * plane.YAxis))
    G.append(rg.Line(plane.Origin, size * plane.ZAxis))
    
    C = []
    C.append(Color.FromArgb(255, 0, 0))
    C.append(Color.FromArgb(0, 255, 0))
    C.append(Color.FromArgb(0, 0, 255))
# ---------- end draw_5 ----------
preview_6 = CustomPreview(Geometry=draw_5.G, Shader=draw_5.C)
preview_7 = CustomPreview(Geometry=[tool_mesh, tool_brep], Shader=ColourSwatch(SwatchColor=RGB(255, 130, 130)))
preview_8 = CustomPreview(Geometry=[robot_mesh, robot_brep], Shader=ColourSwatch(SwatchColor=RGB(166, 166, 166)))

# ---- group: Shows joint positions along path
flip = BooleanToggle(True)
l2t = PythonScript(L=inverse_multiple, flip=flip)  # -> T; inputs L: list, flip: Boolean
# ---------- l2t: Python ----------
from compas_ghpython import list_to_ghtree
L = [l.values for l in L]

if flip:
    L = zip(*L)
T = list_to_ghtree(L)
# ---------- end l2t ----------
graph = QuickGraph(l2t, SortOrder=0)

# ----
panel_14 = Panel("move joints")
idx_3 = Slider(0, range=0..100)
joint_configurations = Data(inverse_multiple)
item = ListItem(List=joint_configurations, Index=idx_3, Wrap=True)
list_8 = ValueList({"send all positions": 0, "send only one position": 1}, selected="send only one position")
filter_2 = StreamFilter(Gate=list_8, Stream0=joint_configurations, Stream1=item)
movej = PythonScript(joint_configurations=filter_2, velocity=Slider(20, range=0..200))  # -> script, values; inputs joint_configurations: list
# ---------- movej: Python ----------
import ur_online_control.ur_direct as urd

joint_config = ["movej({}, v={})".format(c.values, velocity/1000) for c in joint_configurations]

commands = urd.URCommandScript()
commands.start()
commands.add_lines(joint_config)
commands.end()

script = commands.generate()
values = joint_configurations[0].values

print(script)
# ---------- end movej ----------
send_12 = Button()
send_13 = GhPythonScript(script=movej.script, send=send_12)  # -> out; inputs send: Boolean; same code as send_2

idx_4 = Slider(0, range=0..100)
panel_15 = Panel("move cartesian")
planes_wcs_2 = Data(planes_wcs)
list_9 = ValueList({"send all positions": 0, "send only one position": 1}, selected="send only one position")
send_14 = Button()

item_2 = ListItem(List=planes_wcs_2, Index=idx_3, Wrap=True)
filter_3 = StreamFilter(Gate=list_9, Stream0=planes_wcs_2, Stream1=item_2)

movel_4 = PythonScript(commands_input=list_9, planes_WCS=filter_3, idx=idx_4)  # -> script; inputs planes_WCS: list
# ---------- movel_4: Python ----------
import Rhino.Geometry as rg
from compas.geometry import Frame
from compas.geometry import Transformation
from compas_ghpython import draw_frame

from scriptcontext import sticky as st
import ur_online_control.ur_direct as urd

robot = st["robot"]
tool_angle_axis = list(robot.tool.tcp_frame.point) + list(robot.tool.tcp_frame.axis_angle_vector)


move_commands = []
for plane_WCS in planes_WCS:
    frame_WCS = Frame(plane_WCS.Origin, plane_WCS.XAxis, plane_WCS.YAxis)
    frame_RCS = robot.get_frame_in_RCS(frame_WCS)
    cmd = list(frame_RCS.point) + list(frame_RCS.axis_angle_vector) + [50.0, 0.0]
    move_commands.append(cmd)

commands = urd.generate_moves_linear(tool_angle_axis, move_commands, st["ur_ip"], st["ur_port"])
script = commands.script
print(script)
# ---------- end movel_4 ----------
send_15 = GhPythonScript(script=movel_4, send=send_14)  # -> out; inputs send: Boolean; same code as send_2

# ==== cluster Tools

# ---- group: measurement tool
geo = Geometry(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)
mesh = Mesh(geo)
brep = Brep(geo)
mjoin = MeshJoin(Meshes=mesh)
xaxis_line = Curve(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)
yaxis_line = Curve(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)
tool = PythonScript(meshes=mjoin, breps=brep, xline=xaxis_line, yline=yaxis_line)  # -> tool; inputs meshes: list of Mesh, breps: list of Brep
# ---------- tool: Python ----------
import Rhino.Geometry as rg
from compas.geometry import Frame
from ur_online_control.ur.tool import Tool

xaxis = rg.Line(xline.PointAtStart, xline.PointAtEnd)
yaxis = rg.Line(yline.PointAtStart, yline.PointAtEnd)

if xaxis.From.DistanceTo(yaxis.From) < 0.01:
    origin = xaxis.From
    xaxis = xaxis.Direction
    yaxis = yaxis.Direction
elif xaxis.To.DistanceTo(yaxis.To) < 0.01:
    origin = xaxis.To
    xaxis = -xaxis.Direction
    yaxis = -yaxis.Direction
elif xaxis.From.DistanceTo(yaxis.To) < 0.01:
    origin = xaxis.From
    xaxis = xaxis.Direction
    yaxis = -yaxis.Direction
elif xaxis.To.DistanceTo(yaxis.From) < 0.01:
    origin = xaxis.To
    xaxis = -xaxis.Direction
    yaxis = yaxis.Direction

xaxis.Unitize()
yaxis.Unitize()

print origin
print xaxis
print yaxis

tcp_frame = Frame(origin, xaxis, yaxis)

tool = Tool(tcp_frame)
tool.model = meshes
tool.model_breps = breps
# ---------- end tool ----------

# ---- group: air pick 15mm
geo_2 = Geometry(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)
mesh_2 = Mesh(geo_2)
brep_2 = Brep(geo_2)
mjoin_2 = MeshJoin(Meshes=mesh_2)
xaxis_line_2 = Curve(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)
yaxis_line_2 = Curve(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)
tool_2 = PythonScript(meshes=mjoin_2, breps=brep_2, xline=xaxis_line_2, yline=yaxis_line_2)  # -> tool; inputs meshes: list of Mesh, breps: list of Brep; same code as tool

# ---- group: air pick 40mm
geo_3 = Geometry(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)
mesh_3 = Mesh(geo_3)
brep_3 = Brep(geo_3)
mjoin_3 = MeshJoin(Meshes=mesh_3)
xaxis_line_3 = Curve(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)
yaxis_line_3 = Curve(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)
tool_3 = PythonScript(meshes=mjoin_3, breps=brep_3, xline=xaxis_line_3, yline=yaxis_line_3)  # -> tool; inputs meshes: list of Mesh, breps: list of Brep; same code as tool

geo_4 = Geometry(<brep referenced from the Rhino model>)
mesh_4 = Mesh(geo_4)
brep_4 = Brep(geo_4)
mjoin_4 = MeshJoin(Meshes=mesh_4)
xaxis_line_4 = Curve(<curve referenced from the Rhino model>)
yaxis_line_4 = Curve(<curve referenced from the Rhino model>)
tool_4 = PythonScript(meshes=mjoin_4, breps=brep_4, xline=xaxis_line_4, yline=yaxis_line_4)  # -> tool; inputs meshes: list of Mesh, breps: list of Brep; same code as tool

# ----
tool_id = ClusterInput()
tool_id_2 = Integer(tool_id)
filter = StreamFilter(Gate=tool_id_2, Stream1=tool, Stream2=tool_3, Stream3=tool_2, Stream4=tool_4)
py = PythonScript(tool=filter)  # -> tcp_frame, model
# ---------- py: Python ----------
from compas_ghpython import mesh_draw 

if tool:
    tcp_frame = tool.tcp_frame
    model = tool.model
# ---------- end py ----------
tool_5 = Data(filter)
draw = PythonScript(frame=py.tcp_frame)  # -> G, C
# ---------- draw: Python ----------
import Rhino.Geometry as rg
from System.Drawing import Color

if not size:
    size = 100

if frame:
    plane = rg.Plane(rg.Point3d(*list(frame.point)), rg.Vector3d(*list(frame.xaxis)), rg.Vector3d(*list(frame.yaxis)))

    G = []
    G.append(rg.Line(plane.Origin, size * plane.XAxis))
    G.append(rg.Line(plane.Origin, size * plane.YAxis))
    G.append(rg.Line(plane.Origin, size * plane.ZAxis))
    
    C = []
    C.append(Color.FromArgb(255, 0, 0))
    C.append(Color.FromArgb(0, 255, 0))
    C.append(Color.FromArgb(0, 0, 255))
# ---------- end draw ----------
tool_6 = ClusterOutput(tool_5)
preview = CustomPreview(Geometry=py.model, Shader=ColourSwatch(SwatchColor=RGBA(141, 170, 178, 150)))
preview_2 = CustomPreview(Geometry=draw.G, Shader=draw.C)

# ==== cluster Robots
model = ClusterInput()

# ---- group: robot geometry
py = PythonScript(model=model)  # -> n
# ---------- py: Python ----------
import time


if model == "UR5":
    n = 0
if model == "UR10":
    n = 1
if model == "UR10e":
    n = 2

print n
# ---------- end py ----------
ur10e_brep = UR10Brep([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])
ur10_brep = UR10Brep([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])
ur5_brep = UR5Brep([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])
filter = StreamFilter(Gate=py, Stream0=ur5_brep, Stream1=ur10_brep, Stream2=ur10e_brep)

# ----
robot_brep = Brep(filter)
robot_mesh = Mesh(filter)
robot_mesh_2 = ClusterOutput(robot_mesh)
robot_brep_2 = ClusterOutput(robot_brep)

# ==== cluster Draw
frame = ClusterInput()
size = ClusterInput()
draw = PythonScript(frame=frame, size=size)  # -> G, C
# ---------- draw: Python ----------
import Rhino.Geometry as rg
from System.Drawing import Color

if not size:
    size = 100

if frame:
    
    plane = rg.Plane(rg.Point3d(*list(frame.point)), rg.Vector3d(*list(frame.xaxis)), rg.Vector3d(*list(frame.yaxis)))

    G = []
    G.append(rg.Line(plane.Origin, size * plane.XAxis))
    G.append(rg.Line(plane.Origin, size * plane.YAxis))
    G.append(rg.Line(plane.Origin, size * plane.ZAxis))
    
    C = []
    C.append(Color.FromArgb(255, 0, 0))
    C.append(Color.FromArgb(0, 255, 0))
    C.append(Color.FromArgb(0, 0, 255))
# ---------- end draw ----------
G = ClusterOutput(draw.G)
C = ClusterOutput(draw.C)
