# Grasshopper definition ex6_assembly_solar analysis.ghx (Grasshopper 1.0.7)

ladybug = Ladybug_Ladybug()  # -> Vviiiiiiiiiizzz; plug-in component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

# ----
# Weather Data
# Download .epw file
path = FilePath("C:\Users\Bootsy\Downloads\DEU_Munich.108660_IWEC.epw")
importepw = Ladybug_ImportEpw(epwFile=path)  # -> readMe, latitude, location, dryBulbTemperature, dewPointTemperature, relativeHumidity, windSpeed, windDirection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; plug-in component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

panel = Panel(ladybug)
py = PythonScript()  # -> HERE, DATA
# ---------- py: Python ----------
import os

HERE = os.path.dirname(ghdoc.Path)
DATA = os.path.abspath(os.path.join(HERE, "..", "data"))
print(HERE)
print(DATA)
# ---------- end py ----------
pt = Point(<point referenced from the Rhino model>)

panel_2 = Panel("Reload libraries")
bang = Button()
unload = PythonScript(bang=bang)
# ---------- unload: Python ----------
from compas_rhino.utilities.misc import get_tolerance
from compas_rhino.utilities.misc import unload_modules

unload_modules("compas")
unload_modules("compas_fab")
unload_modules("ur_online_control")
unload_modules("climate_active_bricks")
unload_modules("assembly_information_model")
# ---------- end unload ----------

# ----
# Element
# Predefine a brick element and its dimensions
elem_def = GhPythonScript()  # -> out, elem_full, elem_half
# ---------- elem_def: Python ----------
import os
import sys
import json

from compas.geometry import Frame
from compas.geometry import Vector
from compas.geometry import Box

from assembly_information_model.assembly import Element


# dimensions full brick
width = 0.115
length = 0.240
height = 0.050

elem_full = Element.from_dimensions(length, width, height)
elem_full.tool_frame = Frame([0, 0, height], [1, 0, 0], [0, -1, 0])

elem_half = Element.from_dimensions(length/2, width, height)
elem_half.tool_frame = Frame([0, 0, height], [1, 0, 0], [0, -1, 0])
# ---------- end elem_def ----------

# ----
# Assembly
number_slider = Slider(40, range=0..50)
brep = Brep(<brep referenced from the Rhino model>)
pt_2 = Point(<point referenced from the Rhino model>)
python = GhPythonScript(brep=brep, pt_base=pt_2, layers=number_slider)  # -> out, slicing_planes, curves, plane_grid, planes; inputs brep: Brep, layers: Int32
# ---------- python: Python ----------
import Rhino.Geometry as rg
import math
import math as m
from scriptcontext import sticky as st


from compas.geometry import Frame
from compas.geometry import Transformation
from compas.geometry import Rotation
from compas.geometry import Translation
from compas.geometry import Point

from compas_ghpython.geometry import xtransformed
from compas_ghpython import draw_frame

from assembly_information_model.assembly import Assembly

def list_from_2darray(array):
    return [item for sublist in array for item in sublist]

height, width, length = 0.052, 0.115, 0.240

contour_planes = []
base_contour_plane = rg.Plane(pt_base, rg.Vector3d.XAxis, rg.Vector3d.YAxis)
#print(base_contour_plane)

z_value = base_contour_plane.Origin.Z
#print z_value

for i in range(layers):
    contour_plane = rg.Plane(base_contour_plane)
    if i%2 == 0:
        z_value += height
    else:
        z_value += width/2
    #print z_value
    pt = rg.Point3d(base_contour_plane.Origin.X, base_contour_plane.Origin.Y, z_value)
    contour_plane = rg.Plane(pt, base_contour_plane.XAxis, base_contour_plane.YAxis)
    contour_planes.append(contour_plane)
    
curves = []
for s in contour_planes:
    c = rg.Brep.CreateContourCurves(brep, s)
    curves.append(c[0])
    #print(c)

clen = curves[0].GetLength()
cols = int(clen/(length+0.001))*2
print cols

plane_grid = []

for j, c in enumerate(curves):
    row = []
    vparams = rg.Curve.DivideByCount(c, cols, True) #parameters along curve, divided in columns
    planes = rg.Curve.GetPerpendicularFrames(c, vparams) #write frames along curve

    for i, plane in enumerate(planes):

        plane.Rotate(m.radians(-90), plane.YAxis)
        plane.Rotate(m.radians(90), plane.ZAxis)
        #plane.Rotate(m.radians(180), plane.XAxis)

        if j%2 == 0 and i%2 == 0: #even course
            
            if i==0:
              plane.Translate(plane.XAxis*-length/4)
              plane.Rotate(m.radians(-90), plane.ZAxis)
              
            elif i==len(planes)-1:
              plane.Translate(plane.XAxis*length/4)
              plane.Rotate(m.radians(90), plane.ZAxis)
            
            row.append(plane)

        if j%2 == 1 and i%2 == 1: #odd course
            plane.Rotate(m.radians(-90), plane.ZAxis)
            #plane.Translate(plane.YAxis*-height/2)
            row.append(plane)

    plane_grid.append(row)
    
planes = list_from_2darray(plane_grid)
# ---------- end python ----------
crv = Curve(python.curves)
pln = Plane(python.planes)
pln_2 = Plane(python.slicing_planes)
generate_assembly = GhPythonScript(plane_grid=python.plane_grid, elem_full=elem_def.elem_full, elem_half=elem_def.elem_half)  # -> assembly; inputs plane_grid: list
# ---------- generate_assembly: Python ----------
import Rhino.Geometry as rg
import math
from scriptcontext import sticky as st


from compas.geometry import Frame
from compas.geometry import Transformation
from compas.geometry import Rotation
from compas.geometry import Translation
from compas.geometry import Point

from compas_ghpython.geometry import xtransformed
from compas_ghpython import draw_frame

from assembly_information_model.assembly import Assembly


assembly = Assembly() # initialize an empty assembly class


for j, row in enumerate(plane_grid):
    #print row
    for i, plane in enumerate(row):
        #print plane
        rotval = math.sin(i/6)*20
        print rotval
        new_plane= rg.Plane(plane)
        
        #if j%2==0: #even layers
        #    new_plane.Rotate(-math.radians(rotval), plane.ZAxis, plane.Origin)
        
        T = Transformation.from_frame_to_frame(Frame.worldXY(), Frame(new_plane.Origin, new_plane.XAxis, new_plane.YAxis))
        
        if j%2==0: #even layers
            if i==0 or i==len(row)-1:
                e = elem_half.transformed(T)
            else:
                e = elem_full.transformed(T)
        else:
            e = elem_full.transformed(T)
        
        e.current_transformation = Transformation()
        assembly.add_element(e)

"""
if transform:
    T = Transformation.from_frame_to_frame(Frame.worldXY(), Frame(ptransf.Origin, ptransf.XAxis, ptransf.YAxis))
    assembly.transform(T)
"""
# ---------- end generate_assembly ----------

# ----
# Input Data
# Month, Day, Hours etc...
# gives you the analysisPeriod
# 
# Toggle to True
number_slider_2 = Slider(7, range=0..12)
gencumulativeskymtx = Ladybug_GenCumulativeSkyMtx(epwFile=path, skyDensity=0, useOldRes=True, runIt=Toggle(False))  # -> readMe, cumulativeSkyMtx; plug-in component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
analysisperiod = Ladybug_AnalysisPeriod(
    fromMonth=number_slider_2,
    fromHour=Slider(13, range=0..100),
    toMonth=Slider(8, range=0..10),
    toHour=Slider(17, range=0..100))  # -> readMe, analysisPeriod; plug-in component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
data = Data(analysisperiod.analysisPeriod)

# ----
# Brick Rotation
# Var1
# Var2
rot_val = Slider(48, range=-90..90)
rotate = BooleanToggle(True)
rotate_2 = BooleanToggle(True)
pt_3 = Point(<point referenced from the Rhino model>)
rotate_3 = GhPythonScript(assembly=generate_assembly, rotation_degree=rot_val, rotate_all=rotate)  # -> out, assembly
# ---------- rotate_3: Python ----------
import math
import Rhino.Geometry as rg

from compas.geometry import Frame
from compas.geometry import Transformation
from compas.geometry import Rotation
from compas.geometry import Translation
from compas.geometry import Point

from compas_ghpython import draw_frame
from compas_ghpython.geometry import xtransformed


key_index = assembly.network.key_index()
keys = [key_index[key] for key in assembly.network.nodes()]
elements = [assembly.element(key) for key in keys]


if rotate_all:
    for element in elements:
        axis = element.frame.zaxis
        angle = math.radians(rotation_degree)
        point = element.frame.point
        #Rotation()
        R = Rotation.from_axis_and_angle(axis, angle, point=point)
        relative_transformation = R * element.current_transformation.inverse()
        element.transform(relative_transformation)
        element.current_transformation = R
# ---------- end rotate_3 ----------
rotate_4 = GhPythonScript(assembly=rotate_3.assembly, attr_pts=pt_3, rotate_all=rotate_2)  # -> out, assembly; inputs attr_pts: list of Point3d
# ---------- rotate_4: Python ----------
import math
import Rhino.Geometry as rg

from compas.geometry import Frame
from compas.geometry import Transformation
from compas.geometry import Rotation
from compas.geometry import Translation
from compas.geometry import Point

from compas_ghpython import draw_frame
from compas_ghpython.geometry import xtransformed


key_index = assembly.network.key_index()
keys = [key_index[key] for key in assembly.network.nodes()]
elements = [assembly.element(key) for key in keys]


if rotate_all:
    for element in elements:
        point = element.frame.point
        
        min_dist = 50
        for attr_pt in attr_pts:
            dist =  attr_pt.DistanceTo(rg.Point3d(point.x, point.y, point.z))
            if dist<min_dist: min_dist = dist
        dist = min_dist
        
        axis = element.frame.zaxis
        angle = math.radians(1/(0.3*dist*dist))
        
        R = Rotation.from_axis_and_angle(axis, angle, point)
        
        relative_transformation = R * element.current_transformation.inverse()
        element.transform(relative_transformation)
        element.current_transformation = R
# ---------- end rotate_4 ----------

sunpath = Ladybug_SunPath(
    location=importepw.location,
    hour=12,
    day=21,
    month=12,
    timeStep=1,
    analysisPeriod=analysisperiod.analysisPeriod,
    centerPt=pt,
    annualHourlyData=flatten([importepw.dryBulbTemperature, importepw.relativeHumidity]),
    dailyOrAnnualSunPath=True)  # -> readMe, sunVectors, sunAltitudes, sunAzimuths, port, sunSpheresMesh, sunPathCrvs, compassCrvs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; plug-in component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
assembly = Data(rotate_4.assembly)

list = ValueList({"20", "50", "100", "500", "1000", "5000"}, selected="50")
back = Button()
reset = Button()
start = Button()
stop = Button()
step = Button()
full = Button()

# ----
# to JSON
export = Button()
export_2 = Button()
export_3 = PythonScript(DATA=py.DATA, assembly=assembly, export_to_json=export, export_to_json_unity=export_2)
# ---------- export_3: Python ----------
import os
from compas.datastructures.mesh import mesh_quads_to_triangles
from compas.datastructures.mesh import mesh_unify_cycles

if export_to_json:
    
    filename = "brickwall_ex4.json"
    PATH = os.path.join(DATA, filename)
    
    # the assembly has to be serialized such that it can be called from CPython
    assembly.to_json(PATH)
    

if export_to_json_unity:
    
    for key, e in assembly.elements():
    
        #convert to trimesh
        mesh_quads_to_triangles(e._mesh, check_angles=False)
        #mesh_unify_cycles(e._mesh)
        #print e._mesh.faces
        #print e._mesh.face_vertices(list(e._mesh.faces())[0])

    filename = "brickwall_ex4_unity.json"
    PATH = os.path.join(DATA, filename)
    assembly.to_json(PATH)
# ---------- end export_3 ----------

# ----
# Draw
counter = CountThroughList(assembly=assembly, start=start, stop=stop, step=step, step_back=back, reset=reset, full=full, interval=list)  # -> item, counter; inputs start: Boolean, stop: Boolean, step_back: Boolean
# ---------- counter: Python ----------
from scriptcontext import sticky as st
from compas_ghpython import update_component


L = list(assembly.elements())
# store data in component
guid = str(ghenv.Component.InstanceGuid)
counter_key = "counter_" + guid
running_key = "running_" + guid

if counter_key not in st:
    st[counter_key] = 0

if running_key not in st:
    st[running_key] = False
    

if st[running_key]:
    if st[counter_key] < len(L) - 1:
        st[counter_key] += 1
        update_component(ghenv, interval)
    else:
        st[counter_key] = 0
        st[running_key] = False
    
    
if start:
    st[running_key] = True

if stop:
    st[running_key] = False

if step:
    if st[counter_key] < len(L) - 1:
        st[counter_key] += 1

if step_back:
    if st[counter_key] < len(L) - 1:
        st[counter_key] -= 1

if reset:
    st[counter_key] = 0

if full:
    st[counter_key] = len(L)-1

if len(L):
    item = L[st[counter_key]]



#st["visualisation_counter"] = st[counter_key]
#st[counter_key]= 500
counter = st[counter_key]
# ---------- end counter ----------
idx = Panel(counter.counter)

# ---- group: Assembly Artist
show = BooleanToggle(True)
show_2 = BooleanToggle(False)
draw = PythonScript(assembly=assembly, show_all=show, show_counter=show_2, counter=counter.counter)  # -> G, tool_planes_WCS, current_tool_plane; inputs counter: Int32
# ---------- draw: Python ----------
import math

from compas_ghpython.artists import MeshArtist
from compas_ghpython import draw_frame


G = []

key_index = assembly.network.key_index()
keys = [key_index[key] for key in assembly.network.nodes()]
elements = [assembly.element(key) for key in keys]
#print elements
#print([(e.gripping_frame) for e in elements])

tool_planes_WCS = [draw_frame(e.tool_frame) for e in elements]

current_tool_plane = tool_planes_WCS[counter]

if show_all and not show_counter:
    for element in elements:
        artist = MeshArtist(element.mesh)
        mesh = artist.draw_mesh()
        G.append(mesh)

if show_counter:
    for element in elements[0:counter+1]:
        artist = MeshArtist(element.mesh)
        mesh = artist.draw_mesh()
        G.append(mesh)
# ---------- end draw ----------
pln_3 = Plane(draw.tool_planes_WCS)
pln_4 = Plane(draw.current_tool_plane)
geo = Geometry(draw.G)
preview = CustomPreview(Geometry=pln_3, Shader=ColourSwatch(SwatchColor=RGB(178, 178, 178)))
preview_2 = CustomPreview(Geometry=geo, Shader=ColourSwatch(SwatchColor=RGB(255, 255, 255)))

# ----
# Thermal Comfort
# 
# Toggle RunIt to TRUE
toggle = BooleanToggle(True)
outdoorcomfortcalculator = Ladybug_OutdoorComfortCalculator(
    dryBulbTemperature=importepw.dryBulbTemperature,
    relativeHumidity=importepw.relativeHumidity,
    analysisPeriod=analysisperiod.analysisPeriod,
    runIt=toggle)  # -> readMe, port, universalThermalClimateIndex, comfortableOrNot, thermalStress, conditionOfPerson, port_2, percentOfTimeComfortable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; plug-in component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
pt_4 = Point(<point referenced from the Rhino model>)
panel_3 = Panel(outdoorcomfortcalculator.universalThermalClimateIndex)
_3dchart = Ladybug_3DChart(
    inputData=flatten(outdoorcomfortcalculator.conditionOfPerson),
    basePoint=pt_4,
    xScale=Slider(0.3, range=0..1),
    yScale=Slider(0.3, range=0..1),
    zScale=Slider(0.3, range=0..1))  # -> readMe, graphMesh, graphCurves, legend, legendBasePts, title, titleBasePts, dataPts, conditionalHOY; plug-in component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
preview_3 = CustomPreview(
    Geometry=[_3dchart.graphMesh, _3dchart.graphCurves, _3dchart.legend],
    Material={diffuse=RGB(221, 160, 221), emission=RGB(66, 48, 66), shine=0.5, specular=RGB(255, 255, 255), transparency=0})

# ----
# Radiation Analysis
# 
# take care of the grid size
# 
# Context: Create your surrounding and set them to your brep container
# Geometry: Input for your Brick Geometry - Try first on a regular surface - de- or increase the grid size
# 
# Set RunIt to TRUE
selectskymtx = Ladybug_selectSkyMtx(
    cumulativeSkyMtx=gencumulativeskymtx.cumulativeSkyMtx,
    HOY=_3dchart.conditionalHOY,
    analysisPeriod=analysisperiod.analysisPeriod,
    removeDiffuse=False,
    removeDirect=False)  # -> readMe, selectedSkyMtx; plug-in component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
brep_2 = Brep([<brep referenced from the Rhino model> x3])
brep_3 = Brep(<brep referenced from the Rhino model>)
radiationanalysis = Ladybug_RadiationAnalysis(
    geometry=flatten(brep_3),
    context=flatten(brep_2),
    gridSize=Slider(0.1, range=0..10),
    disFromBase=Slider(0.01, range=0..0.01),
    selectedSkyMtx=flatten(selectskymtx.selectedSkyMtx),
    parallel=Toggle(True),
    runIt=Toggle(False))  # -> readMe, contextMesh, analysisMesh, testPts, testVec, port, radiationResult, radiationMesh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; plug-in component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

point = Point(<point referenced from the Rhino model>)

solaradjusttemperature = Ladybug_OutdoorSolarTemperatureAdjustor(
    location=importepw.location,
    cumSkyMtxOrDirNormRad=gencumulativeskymtx.cumulativeSkyMtx,
    diffuseHorizRad=importepw.diffuseHorizontalRadiation,
    baseTemperature=importepw.dryBulbTemperature,
    horizInfraredRad=importepw.horizontalInfraredRadiation,
    bodyPosture=Slider(0, range=0..10),
    rotationAngle=Slider(82, range=0..1000),
    bodyLocation=point,
    analysisPeriodOrHOY=analysisperiod.analysisPeriod,
    parallel=Toggle(True),
    runIt=Toggle(False))  # -> readMe, port, effectiveRadiantField, MRTDelta, solarAdjustedMRT, port_2, mannequinMesh, legend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; plug-in component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

custom_preview = CustomPreview(Geometry=solaradjusttemperature.mannequinMesh, Material=ColourSwatch(SwatchColor=RGB(255, 255, 255)))
